# Grasshopper definition parametric_canopy.gh (Grasshopper 1.0.8)
# plug-ins: LunchBox, Mesh Pipe

# ----
# Variation C
# Surface tesselation (Voronoi)
# Preview and bake
# Tree supports
number_slider = Slider(30, range=0..100)
python_3_script = Python3Script(
    ResU=Slider(30, range=0..100),
    ResV=number_slider,
    Amp=Slider(3, range=0..10),
    Scale=Slider(5, range=0..10),
    Seed=Slider(1, range=0..10),
    Height=Slider(7, range=0..10))  # -> out, Surface; inputs ResU: Int32, ResV: Int32, Seed: Int32
# ---------- python_3_script: Python ----------
"""
Assignment 3: Parametric Structural Canopy — Pseudocode Scaffold

Author: Magnus Støvring

"""

import Rhino.Geometry as rg
import numpy as np


## PERLIN NOISE ##
def perlin_noise(width, height, scale=10, seed=0):
    rng = np.random.default_rng(seed)

    # Random gradient vectors at each grid point #
    gx = rng.random((width+1, height+1)) * 2 - 1
    gy = rng.random((width+1, height+1)) * 2 - 1
    grad = np.stack((gx, gy), axis=-1)

    # Pixel coordinates (scaled domain) #
    xs = np.linspace(0, scale, width, endpoint=False)
    ys = np.linspace(0, scale, height, endpoint=False)
    xx, yy = np.meshgrid(xs, ys, indexing="ij")

    # Corner indices #
    x0 = xx.astype(int)
    y0 = yy.astype(int)
    x1 = x0 + 1
    y1 = y0 + 1

    # Local coordinates inside each cell #
    dx = xx - x0
    dy = yy - y0

    # Fade function #
    def fade(t):
        return 6*t**5 - 15*t**4 + 10*t**3

    tx = fade(dx)
    ty = fade(dy)

    # Dot product helper #
    def dot(ix, iy, x, y):
        g = grad[ix % grad.shape[0], iy % grad.shape[1]]
        return g[...,0]*x + g[...,1]*y

    # Dot at each of the 4 corners #
    n00 = dot(x0, y0, dx, dy)
    n10 = dot(x1, y0, dx-1, dy)
    n01 = dot(x0, y1, dx, dy-1)
    n11 = dot(x1, y1, dx-1, dy-1)

    # Bilinear interpolation using fade weights #
    nx0 = n00*(1-tx) + n10*tx
    nx1 = n01*(1-tx) + n11*tx
    nxy = nx0*(1-ty) + nx1*ty

    # Normalize to [0,1] #
    nxy = (nxy - nxy.min()) / (nxy.max() - nxy.min())

    return nxy



## BUILD THE UV GRID ##
u = np.linspace(0, 1, ResU)
v = np.linspace(0, 1, ResV)
uu, vv = np.meshgrid(u, v, indexing="ij")


## GENERATE HEIGHTMAP FROM PERLIN NOISE ##
H = perlin_noise(ResU, ResV, scale=Scale, seed=Seed)
H = Amp * H + Height

## BUILD POINT GRID USING PERLIN HEIGHTMAP ##
pt_grid = []
for i in range(ResU):
    row = []
    for j in range(ResV):
        x = float(i)
        y = float(j)
        z = float(H[i, j])
        row.append(rg.Point3d(x, y, z))
    pt_grid.append(row)

# Flatten for NURBS constructor #
flat_pts = [p for row in pt_grid for p in row]


## MAKE NURBS SURFACE FROM POINT GRID ##
Surface = rg.NurbsSurface.CreateFromPoints(flat_pts, ResU, ResV, 3, 3)
# ---------- end python_3_script ----------
python_3_script_2 = Python3Script(
    Srf=python_3_script.Surface,
    N=Slider(400, range=200..400),
    Seed=Slider(7, range=0..20),
    MinDist=Slider(0.3, range=0..1),
    SelectedCount=Slider(8, range=0..20),
    MinSpacing=Slider(7, range=0..20),
    PipeRadius=Slider(0.05, range=0..0.1))  # -> Sites3d, SelectedPoints3d, VoronoiCurves3d, VoronoiPipeMeshes, SelectedPoints, OriginalSurface; inputs Srf: Surface, N: Int32, Seed: Int32, MinDist: Double, PipeRadius: Double
# ---------- python_3_script_2: Python ----------
import rhinoscriptsyntax as rs
import Rhino
import random
import math
import heapq
import scriptcontext as sc

EPS = 1e-9
random.seed(Seed)

# ---------------------------------------------------------
# 1. CURVATURE-WEIGHTED SITE GENERATION WITH MIN DISTANCE
# ---------------------------------------------------------
def generate_curvature_weighted_sites(surface, count, grid=100, min_dist=0.0):
    du = surface.Domain(0)
    dv = surface.Domain(1)
    umin, umax = du.T0, du.T1
    vmin, vmax = dv.T0, dv.T1
    uv_list = []
    weights = []
    for i in range(grid):
        u = umin + (i / float(grid - 1)) * (umax - umin)
        for j in range(grid):
            v = vmin + (j / float(grid - 1)) * (vmax - vmin)
            curv_obj = surface.CurvatureAt(u, v)
            mp = abs(curv_obj.Mean) if curv_obj else 0.0
            mp = max(mp, 0.001)
            uv_list.append((u, v))
            weights.append(mp)
    total = sum(weights)
    weights = [w / total for w in weights]
    sites = []
    attempts = 0
    max_attempts = count * 200
    while len(sites) < count and attempts < max_attempts:
        candidate = random.choices(uv_list, weights=weights, k=1)[0]
        too_close = False
        for s in sites:
            p1 = surface.PointAt(candidate[0], candidate[1])
            p2 = surface.PointAt(s[0], s[1])
            if p1.DistanceTo(p2) < min_dist:
                too_close = True
                break
        if not too_close:
            sites.append(candidate)
        attempts += 1
    return sites

# ---------------------------------------------------------
# 2. NEAREST-NEIGHBOR DISTANCE SUM
# ---------------------------------------------------------
def sum_nearest_distances(points, k=10):
    n = len(points)
    sums = []
    for i, pt in enumerate(points):
        distances = [pt.DistanceTo(points[j]) for j in range(n) if j != i]
        nearest_k = heapq.nsmallest(k, distances)
        sums.append(sum(nearest_k))
    return sums

def select_low_distance_points(points, total_distances, count, min_dist):
    pts_with_dist = list(zip(points, total_distances))
    pts_with_dist.sort(key=lambda x: x[1])
    selected = []
    for pt, _ in pts_with_dist:
        if len(selected) >= count:
            break
        too_close = False
        for s in selected:
            if pt.DistanceTo(s) < min_dist:
                too_close = True
                break
        if not too_close:
            selected.append(pt)
    return selected

# ---------------------------------------------------------
# 3. VORONOI BY BISECTOR LINES
# ---------------------------------------------------------
def perp_bisector_line(a, b):
    sx, sy = a
    ox, oy = b
    mx, my = (sx + ox) / 2.0, (sy + oy) / 2.0
    dx, dy = ox - sx, oy - sy
    n = math.hypot(dx, dy)
    if n < EPS: return None
    A, B = dx / n, dy / n
    C = -(A * mx + B * my)
    return A, B, C

def same_side(pt, A, B, C, keep_pt):
    x, y = pt
    kx, ky = keep_pt
    s1 = A * x + B * y + C
    s2 = A * kx + B * ky + C
    if abs(s1) < EPS:
        return True
    return (s1 >= 0) == (s2 >= 0)

def line_seg_intersection(A, B, C, p1, p2):
    x1, y1 = p1
    x2, y2 = p2
    dx, dy = x2 - x1, y2 - y1
    denom = A * dx + B * dy
    if abs(denom) < EPS: return None
    t = -(A * x1 + B * y1 + C) / denom
    if 0 <= t <= 1:
        return (x1 + t*dx, y1 + t*dy)
    return None

def clip_poly(poly, A, B, C, keep_pt):
    if not poly:
        return []
    out = []
    m = len(poly)
    for i in range(m):
        P = poly[i]
        Q = poly[(i + 1) % m]
        Pin = same_side(P, A, B, C, keep_pt)
        Qin = same_side(Q, A, B, C, keep_pt)
        if Pin and Qin:
            out.append(Q)
        elif Pin and not Qin:
            ip = line_seg_intersection(A, B, C, P, Q)
            if ip: out.append(ip)
        elif not Pin and Qin:
            ip = line_seg_intersection(A, B, C, P, Q)
            if ip: out.append(ip)
            out.append(Q)
    return out

def voronoi_on_uv(sites, domain_u, domain_v):
    umin, umax = domain_u
    vmin, vmax = domain_v
    box = [(umin, vmax), (umax, vmax), (umax, vmin), (umin, vmin)]
    cells = []
    for i, site in enumerate(sites):
        cell = box[:]
        for j, other in enumerate(sites):
            if i == j:
                continue
            bis = perp_bisector_line(site, other)
            if bis is None:
                continue
            A, B, C = bis
            cell = clip_poly(cell, A, B, C, site)
            if not cell:
                break
        cells.append(cell)
    return cells

# ---------------------------------------------------------
# 4. EXECUTION
# ---------------------------------------------------------
try:
    du = Srf.Domain(0)
    dv = Srf.Domain(1)
    domain_u = (du.T0, du.T1)
    domain_v = (dv.T0, dv.T1)

    # Generate Voronoi sites
    sites_uv = generate_curvature_weighted_sites(Srf, N, min_dist=MinDist)
    Sites3d = [Srf.PointAt(u, v) for u, v in sites_uv]

    # Voronoi polygons
    vor_uv = voronoi_on_uv(sites_uv, domain_u, domain_v)
    VoronoiCurves3d = []
    for poly in vor_uv:
        pts3d = []
        for u, v in poly:
            pts3d.append(Srf.PointAt(u, v))
        if len(pts3d) >= 3:
            pts3d.append(pts3d[0])
            VoronoiCurves3d.append(Rhino.Geometry.Polyline(pts3d).ToNurbsCurve())

    # Create pipes
    VoronoiPipeMeshes = []
    tolerance = sc.doc.ModelAbsoluteTolerance
    angle_tol = sc.doc.ModelAngleToleranceRadians
    for crv in VoronoiCurves3d:
        if crv and crv.IsValid and crv.GetLength() > 1e-6:
            breps = Rhino.Geometry.Brep.CreatePipe(
                crv, PipeRadius, False,
                Rhino.Geometry.PipeCapMode.Round,
                True, tolerance, angle_tol
            )
            if breps:
                VoronoiPipeMeshes.extend(breps)

    # Select points based on nearest neighbors
    total_dists = sum_nearest_distances(Sites3d, k=10)
    SelectedPoints3d = select_low_distance_points(Sites3d, total_dists, SelectedCount, MinSpacing)

except Exception as e:
    print("Error:", e)
    Sites3d = []
    SelectedPoints3d = []
    VoronoiCurves3d = []
    VoronoiPipeMeshes = []

# ---------------------------------------------------------
# 5. UNIQUE POINTS & RANDOM CLOSEST SELECTION
# ---------------------------------------------------------
try:
    tol = 0.01  # duplicate tolerance
    buckets = {}
    UniquePoints = []

    def bucket_key(pt, tol):
        return (int(round(pt.X / tol)),
                int(round(pt.Y / tol)),
                int(round(pt.Z / tol)))

    # Use SelectedPoints3d as GivenPoints
    GivenPoints = SelectedPoints3d
    Curves = VoronoiCurves3d

    for crv in Curves:
        if crv is None:
            continue
        rc, pl = crv.TryGetPolyline()
        if not rc:
            t = Rhino.Geometry.Polyline()
            if crv.ToPolyline(t):
                pl = t
            else:
                continue
        for pt in pl:
            key = bucket_key(pt, tol)
            if key not in buckets:
                buckets[key] = pt
                UniquePoints.append(pt)

    # Select 6 random closest points for each GivenPoint
    SelectedPoints = []
    for gp in GivenPoints:
        dists = [(gp.DistanceTo(up), up) for up in UniquePoints]
        closest30 = heapq.nsmallest(30, dists, key=lambda x: x[0])
        closest_pts = [pt for dist, pt in closest30]
        selected = random.sample(closest_pts, 6)
        SelectedPoints.extend(selected)

except Exception as e:
    print("Error in closest points selection:", e)
    UniquePoints = []
    SelectedPoints = []
    
# Output the original surface
OriginalSurface = Srf
# ---------- end python_3_script_2 ----------
python_3_script_3 = Python3Script(
    Attractors=python_3_script_2.SelectedPoints,
    srf=python_3_script_2.OriginalSurface,
    Levels=Slider(7, range=0..10),
    Step=Slider(2, range=0..10),
    Seed=Slider(23, range=0..100),
    Thickness=Slider(0.15, range=0..0.15))  # -> out, PipeBreps; inputs Attractors: list of Point3d, srf: Surface, Levels: Int32, Step: Double, Seed: Int32, Thickness: Double
# ---------- python_3_script_3: Python ----------
### ------------------------------------------------- BRANCHING VERTICAL SUPPORTS ------------------------------------------------- ###
import Rhino.Geometry as rg
import random

## PARAMETERS ##
random.seed(Seed)

PipeBreps = []         # Output: GH-previewable Breps
up_first = 1.5         # vertical trunk height
noise = 0.5            # maximum noise magnitude
use_noise = True

## SURFACE ##
if not isinstance(srf, rg.Surface):
    raise Exception("Input srf must be a Rhino Surface!")

## DEFINE ROOT POINTS FROM SURFACE ##
u_domain = srf.Domain(0)
v_domain = srf.Domain(1)

uv_points_normalized = [(0.25, 0.5), (0.75, 0.5)]
roots = []
for u_norm, v_norm in uv_points_normalized:
    u = u_domain.T0 + u_norm * (u_domain.T1 - u_domain.T0)
    v = v_domain.T0 + v_norm * (v_domain.T1 - v_domain.T0)
    pt = srf.PointAt(u, v)
    projected_pt = rg.Point3d(pt.X, pt.Y, 0)
    roots.append(projected_pt)

## SURFACE TO MESH (for trimming) ##
Canopy = rg.Mesh.CreateFromSurface(srf, rg.MeshingParameters.Default)

## TRIM FUNCTION ##
def trim_line_to_canopy(start_pt, end_pt, canopy):
    line = rg.Line(start_pt, end_pt)
    hits = rg.Intersect.Intersection.MeshLine(canopy, line)
    if hits:
        pt = hits[0] if isinstance(hits[0], rg.Point3d) else hits[0].Point
        return pt, True
    return end_pt, False

## ATTRACTOR ASSIGNMENT ##
def assign_attractors(attractors, roots):
    mapping = {pt: [] for pt in roots}
    for a in attractors:
        closest = min(roots, key=lambda r: r.DistanceTo(a))
        mapping[closest].append(a)
    return mapping

def split_into_two(attractors):
    if len(attractors) <= 1:
        return attractors, []

    max_dist = -1
    seedA, seedB = attractors[0], attractors[1]
    for i in range(len(attractors)):
        for j in range(i+1, len(attractors)):
            d = attractors[i].DistanceTo(attractors[j])
            if d > max_dist:
                max_dist = d
                seedA, seedB = attractors[i], attractors[j]

    groupA = [seedA]
    groupB = [seedB]

    for a in attractors:
        if a in (seedA, seedB):
            continue
        if a.DistanceTo(seedA) < a.DistanceTo(seedB):
            groupA.append(a)
        else:
            groupB.append(a)

    return groupA, groupB

## CLUSTER DIRECTION WITH HEIGHT-DEPENDENT NOISE ##
def cluster_direction(from_pt, attractors, level, max_level):
    v = rg.Vector3d(0,0,0)
    for a in attractors:
        v += (a - from_pt)
    if v.IsZero:
        v = rg.Vector3d(0,0,1)
    v.Unitize()

    if use_noise:
        noise_scale = noise * (level / max_level)
        v.X += (random.random() - 0.5) * noise_scale
        v.Y += (random.random() - 0.5) * noise_scale
        v.Z += (random.random() - 0.5) * noise_scale
        v.Unitize()

    return v

## PIPE CREATION ##
def branch_radius(level, max_level):
    tip_radius = 0.05
    # Linear interpolation from Thickness to tip_radius
    r = tip_radius + (Thickness - tip_radius) * (level / max_level)
    return r


def line_to_pipe(start_pt, end_pt, level, max_level):
    r = branch_radius(level, max_level)
    line_vec = end_pt - start_pt
    length = line_vec.Length
    if length < 1e-6:
        return None
    direction = rg.Vector3d(line_vec)
    direction.Unitize()
    plane = rg.Plane(start_pt, direction)
    circle = rg.Circle(plane, r)
    cyl = rg.Cylinder(circle, length)
    brep = cyl.ToBrep(True, True)
    return brep

## RECURSIVE BINARY BRANCHING ##
def grow_binary(start_pt, level, attractors, max_level):
    if level == 0 or len(attractors) == 0:
        return

    # SNAP last-level branches directly to attractor
    if level == 1 and attractors:
        intended = attractors[0]
        end_pt, hit = trim_line_to_canopy(start_pt, intended, Canopy)
        pipe = line_to_pipe(start_pt, end_pt, level, max_level)
        if pipe:
            PipeBreps.append(pipe)
        return

    if len(attractors) == 1:
        v = cluster_direction(start_pt, attractors, level, max_level)
        intended = start_pt + v * Step
        end_pt, hit = trim_line_to_canopy(start_pt, intended, Canopy)
        pipe = line_to_pipe(start_pt, end_pt, level, max_level)
        if pipe:
            PipeBreps.append(pipe)
        if not hit:
            grow_binary(end_pt, level-1, attractors, max_level)
        return

    groupA, groupB = split_into_two(attractors)

    vA = cluster_direction(start_pt, groupA, level, max_level)
    intendedA = start_pt + vA * Step
    endA, hitA = trim_line_to_canopy(start_pt, intendedA, Canopy)
    pipeA = line_to_pipe(start_pt, endA, level, max_level)
    if pipeA:
        PipeBreps.append(pipeA)
    if not hitA:
        grow_binary(endA, level-1, groupA, max_level)

    vB = cluster_direction(start_pt, groupB, level, max_level)
    intendedB = start_pt + vB * Step
    endB, hitB = trim_line_to_canopy(start_pt, intendedB, Canopy)
    pipeB = line_to_pipe(start_pt, endB, level, max_level)
    if pipeB:
        PipeBreps.append(pipeB)
    if not hitB:
        grow_binary(endB, level-1, groupB, max_level)

## TREE GROWTH ##
def grow_tree(root_pt, attractors, levels):
    trunk_top = rg.Point3d(root_pt.X, root_pt.Y, root_pt.Z + up_first)
    trunk_end, hit = trim_line_to_canopy(root_pt, trunk_top, Canopy)
    trunk_pipe = line_to_pipe(root_pt, trunk_end, levels, levels)
    if trunk_pipe:
        PipeBreps.append(trunk_pipe)
    if hit:
        return
    grow_binary(trunk_end, levels-1, attractors, levels)

## MAIN EXECUTION ##
attr_map = assign_attractors(Attractors, roots)

for r in roots:
    grow_tree(r, attr_map[r], Levels)
# ---------- end python_3_script_3 ----------
colour_swatch = ColourSwatch(SwatchColor=RGB(178, 135, 34))
object_bake = ObjectBake(
    BakeToggle=Button(),
    GeometryObjects=[python_3_script_2.VoronoiPipeMeshes, python_3_script_3.PipeBreps],
    Layer="GH_Bake",
    ObjectName="GH_Obj",
    ObjectColor=colour_swatch,
    LayerColor=RGB(255, 255, 255))
custom_preview = CustomPreview(Geometry=python_3_script.Surface, Material=ColourSwatch(SwatchColor=RGBA(231, 255, 255, 99)))
custom_preview_2 = CustomPreview(Geometry=[python_3_script_2.VoronoiPipeMeshes, python_3_script_3.PipeBreps], Material=colour_swatch)

# ----
# Variation A
# Surface tesselation (Voronoi)
# Preview and bake
# Tree supports
number_slider_2 = Slider(20, range=0..100)
python_3_script_4 = Python3Script(
    ResU=Slider(30, range=0..100),
    ResV=number_slider_2,
    Amp=Slider(3, range=0..10),
    Scale=Slider(2, range=0..10),
    Seed=Slider(1, range=0..10),
    Height=Slider(5, range=0..10))  # -> out, Surface; inputs ResU: Int32, ResV: Int32, Seed: Int32; same code as python_3_script
python_3_script_5 = Python3Script(
    Srf=python_3_script_4.Surface,
    N=Slider(250, range=200..300),
    Seed=Slider(7, range=0..20),
    MinDist=Slider(0.3, range=0..1),
    SelectedCount=Slider(5, range=0..20),
    MinSpacing=Slider(7, range=0..20),
    PipeRadius=Slider(0.05, range=0..0.1))  # -> Sites3d, SelectedPoints3d, VoronoiCurves3d, VoronoiPipeMeshes, SelectedPoints, OriginalSurface; inputs Srf: Surface, N: Int32, Seed: Int32, MinDist: Double, PipeRadius: Double; same code as python_3_script_2
python_3_script_6 = Python3Script(
    Attractors=python_3_script_5.SelectedPoints,
    srf=python_3_script_5.OriginalSurface,
    Levels=Slider(7, range=0..10),
    Step=Slider(1.8, range=0..10),
    Seed=Slider(23, range=0..100),
    Thickness=Slider(0.1, range=0..0.15))  # -> out, PipeBreps; inputs Attractors: list of Point3d, srf: Surface, Levels: Int32, Step: Double, Seed: Int32, Thickness: Double; same code as python_3_script_3
colour_swatch_2 = ColourSwatch(SwatchColor=RGB(178, 135, 34))
object_bake_2 = ObjectBake(
    BakeToggle=Button(),
    GeometryObjects=[python_3_script_5.VoronoiPipeMeshes, python_3_script_6.PipeBreps],
    Layer="GH_Bake",
    ObjectName="GH_Obj",
    ObjectColor=colour_swatch_2,
    LayerColor=RGB(255, 255, 255))
custom_preview_3 = CustomPreview(Geometry=python_3_script_4.Surface, Material=ColourSwatch(SwatchColor=RGBA(231, 255, 255, 99)))
custom_preview_4 = CustomPreview(Geometry=[python_3_script_5.VoronoiPipeMeshes, python_3_script_6.PipeBreps], Material=colour_swatch_2)

# ----
# Variation B
number_slider_3 = Slider(15, range=0..100)
python_3_script_7 = Python3Script(
    ResU=Slider(30, range=0..100),
    ResV=number_slider_3,
    Amp=Slider(5, range=0..10),
    Scale=Slider(1, range=0..10),
    Seed=Slider(1, range=0..10),
    Height=Slider(5, range=0..10))  # -> out, Surface; inputs ResU: Int32, ResV: Int32, Seed: Int32; same code as python_3_script
# Surface tesselation (Voronoi)
number_slider_4 = Slider(200, range=200..300)
python_3_script_8 = Python3Script(
    Srf=python_3_script_7.Surface,
    N=number_slider_4,
    Seed=Slider(7, range=0..20),
    MinDist=Slider(0.3, range=0..1),
    SelectedCount=Slider(4, range=0..20),
    MinSpacing=Slider(7, range=0..20),
    PipeRadius=Slider(0.1, range=0..0.1))  # -> Sites3d, SelectedPoints3d, VoronoiCurves3d, VoronoiPipeMeshes, SelectedPoints, OriginalSurface; inputs Srf: Surface, N: Int32, Seed: Int32, MinDist: Double, PipeRadius: Double; same code as python_3_script_2
# Tree supports
number_slider_5 = Slider(10, range=0..10)
python_3_script_9 = Python3Script(
    Attractors=python_3_script_8.SelectedPoints,
    srf=python_3_script_8.OriginalSurface,
    Levels=number_slider_5,
    Step=Slider(1.3, range=0..10),
    Seed=Slider(23, range=0..100),
    Thickness=Slider(0.15, range=0..0.15))  # -> out, PipeBreps; inputs Attractors: list of Point3d, srf: Surface, Levels: Int32, Step: Double, Seed: Int32, Thickness: Double; same code as python_3_script_3
colour_swatch_3 = ColourSwatch(SwatchColor=RGB(178, 135, 34))
# Preview and bake
object_bake_3 = ObjectBake(
    BakeToggle=Button(),
    GeometryObjects=[python_3_script_8.VoronoiPipeMeshes, python_3_script_9.PipeBreps],
    Layer="GH_Bake",
    ObjectName="GH_Obj",
    ObjectColor=colour_swatch_3,
    LayerColor=RGB(255, 255, 255))
custom_preview_5 = CustomPreview(Geometry=python_3_script_7.Surface, Material=ColourSwatch(SwatchColor=RGBA(231, 255, 255, 99)))
custom_preview_6 = CustomPreview(Geometry=[python_3_script_8.VoronoiPipeMeshes, python_3_script_9.PipeBreps], Material=colour_swatch_3)

python_3_script_10 = Python3Script(
    ResU=Slider(30, range=0..100),
    ResV=Slider(20, range=0..100),
    Amp=Slider(3, range=0..10),
    Scale=Slider(2, range=0..10),
    Seed=Slider(1, range=0..10),
    Height=Slider(5, range=0..10))  # -> out, Surface; inputs ResU: Int32, ResV: Int32, Seed: Int32; same code as python_3_script

# ----
# Surface tesselation (Voronoi)
number_slider_6 = Slider(250, range=200..300)
python_3_script_11 = Python3Script(
    Srf=python_3_script_10.Surface,
    N=number_slider_6,
    Seed=Slider(7, range=0..20),
    MinDist=Slider(0.3, range=0..1),
    SelectedCount=Slider(5, range=0..20),
    MinSpacing=Slider(7, range=0..20),
    PipeRadius=Slider(0.05, range=0..0.1))  # -> Sites3d, SelectedPoints3d, VoronoiCurves3d, VoronoiPipeMeshes, SelectedPoints, OriginalSurface; inputs Srf: Surface, N: Int32, Seed: Int32, MinDist: Double, PipeRadius: Double; same code as python_3_script_2

# ----
# Tree supports
number_slider_7 = Slider(7, range=0..10)
python_3_script_12 = Python3Script(
    Attractors=python_3_script_11.SelectedPoints,
    srf=python_3_script_11.OriginalSurface,
    Levels=number_slider_7,
    Step=Slider(1.8, range=0..10),
    Seed=Slider(23, range=0..100),
    Thickness=Slider(0.1, range=0..0.15))  # -> out, PipeBreps; inputs Attractors: list of Point3d, srf: Surface, Levels: Int32, Step: Double, Seed: Int32, Thickness: Double; same code as python_3_script_3

colour_swatch_4 = ColourSwatch(SwatchColor=RGB(178, 135, 34))

# ----
# Preview and bake
button = Button()
object_bake_4 = ObjectBake(
    BakeToggle=button,
    GeometryObjects=[python_3_script_11.VoronoiPipeMeshes, python_3_script_12.PipeBreps],
    Layer="GH_Bake",
    ObjectName="GH_Obj",
    ObjectColor=colour_swatch_4,
    LayerColor=RGB(255, 255, 255))
custom_preview_7 = CustomPreview(Geometry=python_3_script_10.Surface, Material=ColourSwatch(SwatchColor=RGBA(231, 255, 255, 99)))
custom_preview_8 = CustomPreview(Geometry=[python_3_script_11.VoronoiPipeMeshes, python_3_script_12.PipeBreps], Material=colour_swatch_4)

number_slider_8 = Slider(25, range=0..100)  # disabled
number_slider_9 = Slider(26, range=0..100)  # disabled
surface = Surface(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)  # disabled
python_3_script_13 = Python3Script(srf=surface, U=number_slider_8, V=number_slider_9)  # -> out, pts_tree, edges; inputs srf: Surface, U: Int32, V: Int32; disabled
# ---------- python_3_script_13: Python ----------
import rhinoscriptsyntax as rs
import ghpythonlib.treehelpers as th
import math

def sample_uniform_grid(surface, U, V):

    du0, du1 = rs.SurfaceDomain(surface, 0)
    dv0, dv1 = rs.SurfaceDomain(surface, 1)

    pu = [du0 + (du1 - du0)*(i/(float(U))) for i in range (U+1)]
    pv = [dv0 + (dv1 - dv0)*(i/(float(V))) for i in range (V+1)]

    print(pu)
    print(pv)

    pts = []

    for u in pu:
        row = []
        for v in pv:
            tmp_pt = rs.EvaluateSurface(surface, u, v)
            row.append(tmp_pt)
        pts.append(row)
    return pts

def quad_edges_from_points(pts):
    U = len(pts) - 1
    V = len(pts[0])-1

    lines = []

    for i in range(U+1):
        for j in range(V+1):
            if i < U:
                tmp_line = rs.AddLine(pts[i][j], pts[i+1][j])
                lines.append(tmp_line)
            if j < V: #"hroizontal"
                tmp_line = rs.AddLine(pts[i][j], pts[i][j+1])
                lines.append(tmp_line)
    return lines


## MAIN EXECUTION ##
print("U_value: ", U, "V Value: ", V)

pts = sample_uniform_grid(srf, U, V)
pts_tree = th.list_to_tree(pts)

edges = quad_edges_from_points(pts)
# ---------- end python_3_script_13 ----------

number_slider_10 = Slider(5, range=0..10)  # disabled
number_slider_11 = Slider(30, range=0..100)  # disabled
number_slider_12 = Slider(3, range=0..10)  # disabled
number_slider_13 = Slider(7, range=0..10)  # disabled
number_slider_14 = Slider(7, range=0..10)  # disabled
number_slider_15 = Slider(50, range=0..100)  # disabled
python_3_script_14 = Python3Script(
    ResU=number_slider_15,
    ResV=number_slider_11,
    Amp=number_slider_12,
    Scale=number_slider_13,
    Seed=number_slider_14,
    Height=number_slider_10)  # -> out, Surface; inputs ResU: Int32, ResV: Int32, Seed: Int32; disabled; same code as python_3_script
surface_points = SurfacePoints(Surface=python_3_script_14.Surface)  # -> Points, Weights, Greville, UCount, VCount; disabled
deconstruct = Deconstruct(Point=surface_points.Points)  # -> XComponent, YComponent, ZComponent; disabled
bounds = Bounds(Numbers=deconstruct.ZComponent)  # disabled
deconstruct_domain = DeconstructDomain(Domain=bounds)  # -> Start, End; disabled
gradient = Gradient(
    LowerLimit=deconstruct_domain.Start,
    UpperLimit=deconstruct_domain.End,
    Parameter=deconstruct.ZComponent,
    stops=[0: RGB(75, 107, 169), 0.252: RGB(173, 203, 249), 0.5: RGB(254, 244, 84), 0.751: RGB(234, 126, 0), 1: RGB(234, 38, 0)])  # disabled
custom_preview_9 = CustomPreview(Geometry=surface_points.Points, Material=gradient)  # disabled

# ----
# Voronoi 3d
number_slider_16 = Slider(5, range=0..10)  # disabled
number_slider_17 = Slider(20, range=0..100)  # disabled
number_slider_18 = Slider(30, range=0..100)  # disabled
number_slider_19 = Slider(3, range=0..10)  # disabled
number_slider_20 = Slider(2, range=0..10)  # disabled
number_slider_21 = Slider(1, range=0..10)  # disabled
python_3_script_15 = Python3Script(
    ResU=number_slider_18,
    ResV=number_slider_17,
    Amp=number_slider_19,
    Scale=number_slider_20,
    Seed=number_slider_21,
    Height=number_slider_16)  # -> out, Surface; inputs ResU: Int32, ResV: Int32, Seed: Int32; disabled; same code as python_3_script
number_slider_22 = Slider(250, range=0..300)  # disabled
number_slider_23 = Slider(0.3, range=0..1)  # disabled
number_slider_24 = Slider(7, range=0..20)  # disabled
python_3_script_16 = Python3Script(Srf=python_3_script_15.Surface, N=number_slider_22, Seed=number_slider_24, MinDist=number_slider_23)  # -> VoronoiCurves3d, VoronoiPolylinesUV, Sites3d; inputs Srf: Surface, N: Int32, Seed: Int32, MinDist: Double; disabled
# ---------- python_3_script_16: Python ----------
import rhinoscriptsyntax as rs
import Rhino
import random
import math

EPS = 1e-9

# ---------------------------------------------------------
# 0. APPLY RANDOM SEED
# ---------------------------------------------------------
if Seed is not None:
    random.seed(Seed)
else:
    random.seed()

# ---------------------------------------------------------
# 1. CURVATURE-WEIGHTED SITE GENERATION WITH MIN DISTANCE
# ---------------------------------------------------------
def generate_curvature_weighted_sites(surface, count, grid=100, min_dist=0.0):
    du = surface.Domain(0)
    dv = surface.Domain(1)
    
    umin, umax = du.T0, du.T1
    vmin, vmax = dv.T0, dv.T1
    
    uv_list = []
    weights = []

    # Sample curvature on UV grid
    for i in range(grid):
        u = umin + (float(i)/(grid-1))*(umax - umin)
        for j in range(grid):
            v = vmin + (float(j)/(grid-1))*(vmax - vmin)
            
            curv_obj = surface.CurvatureAt(u, v)
            mp = abs(curv_obj.Mean) if curv_obj else 0.0
            mp = max(mp, 0.001)
            
            uv_list.append((u, v))
            weights.append(mp)
    
    # Normalize weights
    total = sum(weights)
    weights = [w / total for w in weights]
    
    # Weighted random sampling with minimum distance
    sites = []
    attempts = 0
    max_attempts = count * 200
    while len(sites) < count and attempts < max_attempts:
        candidate = random.choices(uv_list, weights=weights, k=1)[0]
        too_close = False
        for s in sites:
            p1 = surface.PointAt(candidate[0], candidate[1])
            p2 = surface.PointAt(s[0], s[1])
            if p1.DistanceTo(p2) < min_dist:
                too_close = True
                break
        if not too_close:
            sites.append(candidate)
        attempts += 1
    
    if len(sites) < count:
        print("Warning: Could not place all sites respecting MinDist. Placed", len(sites), "sites.")
    
    return sites

# ---------------------------------------------------------
# 2. VORONOI UTILS
# ---------------------------------------------------------
def uv_to_point3d(surface, uv):
    u, v = uv
    return surface.PointAt(u, v)

def perp_bisector_line(a, b):
    sx, sy = a
    ox, oy = b
    mx, my = (sx+ox)/2.0, (sy+oy)/2.0
    dx, dy = ox - sx, oy - sy
    n = math.hypot(dx, dy)
    if n < EPS:
        return None
    A, B = dx/n, dy/n
    C = -(A*mx + B*my)
    return A, B, C

def same_side(pt, A, B, C, keep_pt):
    x, y = pt
    kx, ky = keep_pt
    s1 = A*x + B*y + C
    s2 = A*kx + B*ky + C
    if abs(s1) < EPS:
        return True
    return (s1 >= 0) == (s2 >= 0)

def line_seg_intersection(A, B, C, p1, p2):
    x1, y1 = p1
    x2, y2 = p2
    dx, dy = x2 - x1, y2 - y1
    denom = A*dx + B*dy
    if abs(denom) < EPS:
        return None
    t = -(A*x1 + B*y1 + C)/denom
    if 0 <= t <= 1:
        return (x1 + t*dx, y1 + t*dy)
    return None

def clip_poly(poly, A, B, C, keep_pt):
    if not poly:
        return []
    out = []
    m = len(poly)
    for i in range(m):
        P = poly[i]
        Q = poly[(i+1)%m]
        Pin = same_side(P, A,B,C, keep_pt)
        Qin = same_side(Q, A,B,C, keep_pt)
        if Pin and Qin:
            out.append(Q)
        elif Pin and not Qin:
            ip = line_seg_intersection(A,B,C,P,Q)
            if ip:
                out.append(ip)
        elif not Pin and Qin:
            ip = line_seg_intersection(A,B,C,P,Q)
            if ip:
                out.append(ip)
            out.append(Q)
    return out

# ---------------------------------------------------------
# 3. MAIN VORONOI IN UV (NO PAD)
# ---------------------------------------------------------
def voronoi_on_uv(sites, domain_u, domain_v):
    umin, umax = domain_u
    vmin, vmax = domain_v
    
    box = [
        (umin, vmax),
        (umax, vmax),
        (umax, vmin),
        (umin, vmin)
    ]
    
    cells = []
    
    for i, site in enumerate(sites):
        cell = box[:]
        for j, other in enumerate(sites):
            if i == j:
                continue
            bis = perp_bisector_line(site, other)
            if bis is None:
                continue
            A, B, C = bis
            cell = clip_poly(cell, A, B, C, site)
            if not cell:
                break
        cells.append(cell)
    
    return cells

# ---------------------------------------------------------
# 4. EXECUTION
# ---------------------------------------------------------
try:
    du = Srf.Domain(0)
    dv = Srf.Domain(1)
    domain_u = (du.T0, du.T1)
    domain_v = (dv.T0, dv.T1)

    # Generate curvature-weighted sites with minimum distance
    sites_uv = generate_curvature_weighted_sites(Srf, N, min_dist=MinDist)

    # Convert UV sites to 3D points
    Sites3d = [Srf.PointAt(u, v) for u, v in sites_uv]

    # Compute Voronoi polygons in UV
    vor_uv = voronoi_on_uv(sites_uv, domain_u, domain_v)

    # Convert Voronoi polygons to 3D curves
    VoronoiCurves3d = []
    for poly in vor_uv:
        if len(poly) < 3:
            VoronoiCurves3d.append(None)
            continue
        pts = [Srf.PointAt(u, v) for u, v in poly]
        pts.append(pts[0])
        VoronoiCurves3d.append(Rhino.Geometry.Polyline(pts).ToNurbsCurve())

    VoronoiPolylinesUV = vor_uv

except Exception as e:
    print("Error:", e)
    Sites3d = []
    VoronoiCurves3d = []
    VoronoiPolylinesUV = []
# ---------- end python_3_script_16 ----------
panel = Panel("0.05")  # disabled
mesh_pipe = MeshPipe(Curve=python_3_script_16.VoronoiCurves3d, Radius=panel, Accuracy=0.2, Rotation=0, Segments=10, Caps=2)  # disabled

# ----
# Voronoi 3d
number_slider_25 = Slider(20, range=0..100)  # disabled
number_slider_26 = Slider(5, range=0..10)  # disabled
number_slider_27 = Slider(3, range=0..10)  # disabled
number_slider_28 = Slider(2, range=0..10)  # disabled
number_slider_29 = Slider(1, range=0..10)  # disabled
number_slider_30 = Slider(30, range=0..100)  # disabled
colour_swatch_5 = ColourSwatch(SwatchColor=RGBA(231, 255, 255, 99))  # disabled
python_3_script_17 = Python3Script(
    ResU=number_slider_30,
    ResV=number_slider_25,
    Amp=number_slider_27,
    Scale=number_slider_28,
    Seed=number_slider_29,
    Height=number_slider_26)  # -> out, Surface; inputs ResU: Int32, ResV: Int32, Seed: Int32; disabled; same code as python_3_script
number_slider_31 = Slider(250, range=0..300)  # disabled
custom_preview_10 = CustomPreview(Geometry=python_3_script_17.Surface, Material=colour_swatch_5)  # disabled
number_slider_32 = Slider(5, range=0..20)  # disabled
number_slider_33 = Slider(7, range=0..20)  # disabled
number_slider_34 = Slider(7, range=0..20)  # disabled
number_slider_35 = Slider(0.3, range=0..1)  # disabled
python_3_script_18 = Python3Script(
    Srf=python_3_script_17.Surface,
    N=number_slider_31,
    Seed=number_slider_34,
    MinDist=number_slider_35,
    SelectedCount=number_slider_32,
    MinSpacing=number_slider_33)  # -> VoronoiCurves3d, VoronoiPolylinesUV, Sites3d, SelectedPoints3d; inputs Srf: Surface, N: Int32, Seed: Int32, MinDist: Double; disabled
# ---------- python_3_script_18: Python ----------
import rhinoscriptsyntax as rs
import Rhino
import random
import math
import heapq

EPS = 1e-9  # Small epsilon for numerical stability
random.seed(Seed)

# ---------------------------------------------------------
# 1. CURVATURE-WEIGHTED SITE GENERATION WITH MIN DISTANCE
# ---------------------------------------------------------
def generate_curvature_weighted_sites(surface, count, grid=100, min_dist=0.0):
    du = surface.Domain(0)
    dv = surface.Domain(1)
    umin, umax = du.T0, du.T1
    vmin, vmax = dv.T0, dv.T1
    uv_list = []
    weights = []
    for i in range(grid):
        u = umin + (float(i)/(grid-1))*(umax - umin)
        for j in range(grid):
            v = vmin + (float(j)/(grid-1))*(vmax - vmin)
            curv_obj = surface.CurvatureAt(u, v)
            mp = abs(curv_obj.Mean) if curv_obj else 0.0
            mp = max(mp, 0.001)
            uv_list.append((u, v))
            weights.append(mp)
    total = sum(weights)
    weights = [w / total for w in weights]
    sites = []
    attempts = 0
    max_attempts = count * 200
    while len(sites) < count and attempts < max_attempts:
        candidate = random.choices(uv_list, weights=weights, k=1)[0]
        too_close = False
        for s in sites:
            p1 = surface.PointAt(candidate[0], candidate[1])
            p2 = surface.PointAt(s[0], s[1])
            if p1.DistanceTo(p2) < min_dist:
                too_close = True
                break
        if not too_close:
            sites.append(candidate)
        attempts += 1
    return sites

# ---------------------------------------------------------
# 2. NEAREST-NEIGHBOR DISTANCE SUM (Post-processing)
# ---------------------------------------------------------
def sum_nearest_distances(points, k=10):
    n = len(points)
    sums = []
    for i, pt in enumerate(points):
        distances = [pt.DistanceTo(points[j]) for j in range(n) if j != i]
        nearest_k = heapq.nsmallest(k, distances)
        sums.append(sum(nearest_k))
    return sums

def select_low_distance_points(points, total_distances, count, min_dist):
    pts_with_dist = list(zip(points, total_distances))
    pts_with_dist.sort(key=lambda x: x[1])
    selected = []
    for pt, _ in pts_with_dist:
        if len(selected) >= count:
            break
        too_close = False
        for s in selected:
            if pt.DistanceTo(s) < min_dist:
                too_close = True
                break
        if not too_close:
            selected.append(pt)
    return selected

# ---------------------------------------------------------
# 3. VORONOI BY BISECTOR LINES (unchanged)
# ---------------------------------------------------------
def perp_bisector_line(a, b):
    sx, sy = a
    ox, oy = b
    mx, my = (sx + ox)/2.0, (sy + oy)/2.0
    dx, dy = ox - sx, oy - sy
    n = math.hypot(dx, dy)
    if n < EPS: return None
    A, B = dx/n, dy/n
    C = -(A*mx + B*my)
    return A, B, C

def same_side(pt, A, B, C, keep_pt):
    x, y = pt
    kx, ky = keep_pt
    s1 = A*x + B*y + C
    s2 = A*kx + B*ky + C
    if abs(s1) < EPS: return True
    return (s1 >= 0) == (s2 >= 0)

def line_seg_intersection(A, B, C, p1, p2):
    x1, y1 = p1
    x2, y2 = p2
    dx, dy = x2 - x1, y2 - y1
    denom = A*dx + B*dy
    if abs(denom) < EPS: return None
    t = -(A*x1 + B*y1 + C)/denom
    if 0 <= t <= 1:
        return (x1 + t*dx, y1 + t*dy)
    return None

def clip_poly(poly, A, B, C, keep_pt):
    if not poly: return []
    out = []
    m = len(poly)
    for i in range(m):
        P = poly[i]
        Q = poly[(i+1) % m]
        Pin = same_side(P, A, B, C, keep_pt)
        Qin = same_side(Q, A, B, C, keep_pt)
        if Pin and Qin:
            out.append(Q)
        elif Pin and not Qin:
            ip = line_seg_intersection(A, B, C, P, Q)
            if ip: out.append(ip)
        elif not Pin and Qin:
            ip = line_seg_intersection(A, B, C, P, Q)
            if ip: out.append(ip)
            out.append(Q)
    return out

def voronoi_on_uv(sites, domain_u, domain_v):
    umin, umax = domain_u
    vmin, vmax = domain_v
    box = [(umin, vmax), (umax, vmax), (umax, vmin), (umin, vmin)]
    cells = []
    for i, site in enumerate(sites):
        cell = box[:]
        for j, other in enumerate(sites):
            if i == j: continue
            bis = perp_bisector_line(site, other)
            if bis is None: continue
            A, B, C = bis
            cell = clip_poly(cell, A, B, C, site)
            if not cell: break
        cells.append(cell)
    return cells

# ---------------------------------------------------------
# 4. EXECUTION
# ---------------------------------------------------------
try:
    du = Srf.Domain(0)
    dv = Srf.Domain(1)
    domain_u = (du.T0, du.T1)
    domain_v = (dv.T0, dv.T1)

    # Generate curvature-weighted sites for Voronoi (unchanged)
    sites_uv = generate_curvature_weighted_sites(Srf, N, min_dist=MinDist)
    Sites3d = [Srf.PointAt(u, v) for u, v in sites_uv]

    # Compute Voronoi polygons (unchanged)
    vor_uv = voronoi_on_uv(sites_uv, domain_u, domain_v)
    VoronoiCurves3d = []
    for poly in vor_uv:
        if len(poly) < 3:
            VoronoiCurves3d.append(None)
            continue
        pts = [Srf.PointAt(u, v) for u, v in poly]
        pts.append(pts[0])
        VoronoiCurves3d.append(Rhino.Geometry.Polyline(pts).ToNurbsCurve())

    # ---------------------------
    # NEW: Find points with lowest total distance to neighbors
    # ---------------------------
    total_dists = sum_nearest_distances(Sites3d, k=10)
    SelectedPoints3d = select_low_distance_points(Sites3d, total_dists, SelectedCount, MinSpacing)

except Exception as e:
    print("Error:", e)
    Sites3d = []
    SelectedPoints3d = []
    VoronoiCurves3d = []
    vor_uv = []
# ---------- end python_3_script_18 ----------
point = Point(python_3_script_18.SelectedPoints3d)  # disabled
mesh_pipe_2 = MeshPipe(Curve=python_3_script_18.VoronoiCurves3d, Radius=0.05, Accuracy=0.2, Rotation=0, Segments=10, Caps=2)  # disabled

# ----
# Voronoi 2d
number_slider_36 = Slider(30, range=0..100)  # disabled
number_slider_37 = Slider(20, range=0..100)  # disabled
rectangle = Rectangle(Plane=PlaneXY(0, 0, 0), XSize=number_slider_36, YSize=number_slider_37, Radius=0)  # -> Rectangle, Length; disabled
boundary_surfaces = BoundarySurfaces(Edges=rectangle.Rectangle)  # disabled
number_slider_38 = Slider(0.5, range=0..1)  # disabled
number_slider_39 = Slider(100, range=0..100)  # disabled
python_3_script_19 = Python3Script(Srf=boundary_surfaces, N=number_slider_39, Pad=number_slider_38)  # -> VoronoiPolylinesUV, VoronoiCurves3d; inputs Srf: Surface, N: Int32, Pad: Double; disabled
# ---------- python_3_script_19: Python ----------
import rhinoscriptsyntax as rs
import Rhino
import random
import math

EPS = 1e-9

# --------- Automatic RANDOM Sites on Surface ----------
def generate_random_sites_uv(surface, count):
    du = surface.Domain(0)
    dv = surface.Domain(1)
    sites_uv = []
    for _ in range(count):
        u = random.uniform(du.T0, du.T1)
        v = random.uniform(dv.T0, dv.T1)
        sites_uv.append((u, v))
    return sites_uv

# --------- Utility Functions ----------
def uv_to_point3d(surface, uv):
    u, v = uv
    return surface.PointAt(u, v)

def perp_bisector_line(site_uv, other_uv):
    sx, sy = site_uv
    ox, oy = other_uv
    mx = (sx + ox)/2.0
    my = (sy + oy)/2.0

    dx = ox - sx
    dy = oy - sy

    A = dx
    B = dy
    n = math.hypot(A,B)
    if n < EPS: return None
    A /= n
    B /= n
    C = -(A*mx + B*my)
    return (A,B,C)

def is_point_in_halfplane(pt, A,B,C, keep):
    x,y = pt
    px,py = keep
    s_pt = A*x + B*y + C
    s_keep = A*px + B*py + C
    if abs(s_pt) < EPS: return True
    return (s_pt >= 0) == (s_keep >= 0)

def line_segment_intersection(A,B,C, p1, p2):
    x1,y1 = p1
    x2,y2 = p2
    dx = x2-x1
    dy = y2-y1
    denom = A*dx + B*dy
    if abs(denom) < EPS: return None
    t = -(A*x1 + B*y1 + C) / denom
    if 0 <= t <= 1:
        return (x1+t*dx, y1+t*dy)
    return None

def clip_polygon_by_halfplane(poly, A,B,C, keep):
    if not poly: return []
    out = []
    m = len(poly)
    for i in range(m):
        P = poly[i]
        Q = poly[(i+1) % m]
        Pin = is_point_in_halfplane(P,A,B,C,keep)
        Qin = is_point_in_halfplane(Q,A,B,C,keep)
        if Pin and Qin:
            out.append(Q)
        elif Pin and not Qin:
            ip = line_segment_intersection(A,B,C,P,Q)
            if ip: out.append(ip)
        elif not Pin and Qin:
            ip = line_segment_intersection(A,B,C,P,Q)
            if ip: out.append(ip)
            out.append(Q)
    return out

def make_uv_box(domain_u, domain_v, pad=0.0):
    return [
        (domain_u[0]-pad, domain_v[1]+pad),
        (domain_u[1]+pad, domain_v[1]+pad),
        (domain_u[1]+pad, domain_v[0]-pad),
        (domain_u[0]-pad, domain_v[0]-pad)
    ]

def voronoi_on_uv(sites_uv, domain_u, domain_v, pad=0.0):
    n = len(sites_uv)
    box = make_uv_box(domain_u, domain_v, pad)
    cells = []
    for i in range(n):
        site = sites_uv[i]
        cell = box[:]
        for j in range(n):
            if i == j: continue
            other = sites_uv[j]
            line = perp_bisector_line(site, other)
            if line is None: continue
            A,B,C = line
            cell = clip_polygon_by_halfplane(cell, A,B,C, site)
            if not cell: break
        cells.append(cell)
    return cells

# --------- MAIN EXECUTION ---------

try:
    Pad = Pad or 0.0
    Count = N  # number of sites

    # Surface domain:
    du = Srf.Domain(0)
    dv = Srf.Domain(1)
    domain_u = (du.T0, du.T1)
    domain_v = (dv.T0, dv.T1)

    # Generate sites automatically:
    sites_uv = generate_random_sites_uv(Srf, Count)

    # Voronoi in UV:
    vor_uv = voronoi_on_uv(sites_uv, domain_u, domain_v, Pad)

    # Convert to 3D:
    curves3d = []
    for cell in vor_uv:
        if len(cell) < 3:
            curves3d.append(None)
            continue
        pts = [uv_to_point3d(Srf, uv) for uv in cell]
        pts.append(pts[0])  # close polyline
        poly = Rhino.Geometry.Polyline(pts).ToNurbsCurve()
        curves3d.append(poly)

    VoronoiPolylinesUV = vor_uv
    VoronoiCurves3d = curves3d
    SitesUV = sites_uv  # optional output if you want to visualize sites

except Exception as e:
    print("Error:", e)
    VoronoiPolylinesUV = []
    VoronoiCurves3d = []
    SitesUV = []
# ---------- end python_3_script_19 ----------

# ----
# Part of the process
number_slider_40 = Slider(300, range=0..300)  # disabled

# ----
# Voronoi 3d
number_slider_41 = Slider(20, range=0..100)  # disabled
number_slider_42 = Slider(5, range=0..10)  # disabled
number_slider_43 = Slider(3, range=0..10)  # disabled
number_slider_44 = Slider(7, range=0..10)  # disabled
number_slider_45 = Slider(7, range=0..10)  # disabled
number_slider_46 = Slider(30, range=0..100)  # disabled
python_3_script_20 = Python3Script(
    ResU=number_slider_46,
    ResV=number_slider_41,
    Amp=number_slider_43,
    Scale=number_slider_44,
    Seed=number_slider_45,
    Height=number_slider_42)  # -> out, Surface; inputs ResU: Int32, ResV: Int32, Seed: Int32; disabled; same code as python_3_script
number_slider_47 = Slider(0, range=0..1)  # disabled
python_3_script_21 = Python3Script(Srf=python_3_script_20.Surface, N=number_slider_40, Pad=number_slider_47)  # -> VoronoiCurves3d; inputs Srf: Surface, N: Int32, Pad: Double; disabled; same code as python_3_script_19
panel_2 = Panel("0.05")  # disabled
mesh_pipe_3 = MeshPipe(Curve=python_3_script_21, Radius=panel_2, Accuracy=0.2, Rotation=0, Segments=10, Caps=2)  # disabled
