# Grasshopper definition agent_panelization.gh (Grasshopper 1.0.8)

# ---- group: RunStep button
md_slider = MDSlider(
    SliderMode=0,
    slider_value=Point(0.2608828661, 0.4956069574, 0.5),
    x_domain=Domain(0, 1),
    y_domain=Domain(0, 1),
    z_domain=Domain(0, 1))
surface_generator = Python3Script(
    Width=Slider(20, range=0..100),
    Height=Slider(20, range=0..100),
    Scale=Slider(5, range=0..10),
    Seed=Slider(42, range=0..100),
    Amp=Slider(4, range=0..10))  # -> Pts, Surface; inputs Width: Int32, Height: Int32, Scale: Int32, Seed: Int32, Amp: Double
# ---------- surface_generator: Python ----------
"""GhPython Script: Heightmap Surface
Purpose:
    Generate a Perlin-like noise heightmap and build a Rhino NURBS surface
    from the resulting grid of points.

Inputs:
    Width   : int, number of samples in X direction
    Height  : int, number of samples in Y direction
    Scale   : int, roughness scale (larger = smoother)
    Seed    : int, random seed
    Amp     : float, amplitude scaling for Z heights
Outputs:
    Surface : Rhino NurbsSurface built from heightmap
    Pts     : list of Point3d grid points
"""

import Rhino.Geometry as rg
import numpy as np

# --- Noise function ---
def perlin_noise_vectorized(height, width, scale=30, seed=0):
    rng = np.random.default_rng(seed)

    grid_y = height // scale + 2
    grid_x = width // scale + 2
    grid = rng.random((grid_y, grid_x))

    y = np.arange(height)
    x = np.arange(width)
    X, Y = np.meshgrid(x, y)

    gx = X // scale
    gy = Y // scale
    tx = (X % scale) / scale
    ty = (Y % scale) / scale

    v00 = grid[gy, gx]
    v10 = grid[gy, gx + 1]
    v01 = grid[gy + 1, gx]
    v11 = grid[gy + 1, gx + 1]

    i1 = v00 + tx * (v10 - v00)
    i2 = v01 + tx * (v11 - v01)
    noise = i1 + ty * (i2 - i1)

    return noise

# --- Main program ---
if Width < 2 or Height < 2:
    Surface = None
    Pts = []
else:
    noise = perlin_noise_vectorized(Height, Width, scale=Scale, seed=Seed)

    # Normalize to [0,1]
    noise = (noise - noise.min()) / (noise.max() - noise.min())

    # Scale by amplitude
    H = Amp * noise

    # Build grid of points
    pt_grid = []
    for i in range(Width):
        row = []
        for j in range(Height):
            x = float(i)
            y = float(j)
            z = float(H[j, i])  # note: meshgrid indexing
            row.append(rg.Point3d(x, y, z))
        pt_grid.append(row)

    # Flatten points for surface constructor
    flat_pts = [p for row in pt_grid for p in row]

    # Create NURBS surface from point grid
    try:
        Surface = rg.NurbsSurface.CreateFromPoints(flat_pts, Width, Height, 3, 3)
    except:
        Surface = None

    Pts = flat_pts
# ---------- end surface_generator ----------
surface = Surface(surface_generator.Surface)
evaluate_surface = EvaluateSurface(Surface=reparameterize(surface), Point=md_slider)  # -> Point, Normal, UDirection, VDirection, Frame
agent_builder = Python3Script(Srf=surface, DivU="14", DivV="14")  # -> Pts, Agents; inputs Srf: Surface, DivU: Int32, DivV: Int32
# ---------- agent_builder: Python ----------
"""GhPython Script: Agent Builder
Inputs:
    Srf   : Surface (Rhino surface)
    DivU  : int, divisions in U
    DivV  : int, divisions in V
Outputs:
    Agents : list of Agent objects
    Pts    : list of Point3d positions
"""

import rhinoscriptsyntax as rs
import Rhino.Geometry as rg

# -- Agent Class --
class Agent:
    """Represents a single agent with position, velocity, and placeholders."""
    def __init__(self, position, velocity):
        self.position = position
        self.velocity = velocity
        self.min_distance = None
        self.curvature_value = None
        self.repulsor_forces = []
        self.id = None

    def initialize_state(self):
        """Not used in builder, but exists for future expansion."""
        pass

# -- Factory Function --
def build_agents(surface, div_u, div_v):
    if surface is None: return [], []
    if div_u < 1 or div_v < 1: return [], []

    agents, points = [], []
    agent_id = 0

    dom_u = surface.Domain(0)
    dom_v = surface.Domain(1)

    for i in range(div_u + 1):
        u = dom_u.T0 + (i/float(div_u)) * (dom_u.T1 - dom_u.T0)
        for j in range(div_v + 1):
            v = dom_v.T0 + (j/float(div_v)) * (dom_v.T1 - dom_v.T0)
            pt = surface.PointAt(u, v)
            points.append(pt)
            vel = rg.Vector3d(0,0,0)
            agent = Agent(pt, vel)
            agent.id = agent_id
            agent_id += 1
            agents.append(agent)

    return agents, points

# -- Outputs --
Agents, Pts = build_agents(Srf, DivU, DivV)
# ---------- end agent_builder ----------
point = Point(evaluate_surface.Point)
agent_simulator = Python3Script(
    Surface=surface,
    RepulsorPts=point,
    MinDistance=Slider(0.8, range=0..10),
    Agents=agent_builder.Agents,
    RunStep=Button(),
    Reset=Button(),
    RepulsionWeight=Slider(0, range=0..0.1),
    CurvatureWeight=Slider(1, range=0..1),
    SeparationWeight=Slider(0.7, range=0..1),
    BoundaryWeight=Slider(0.6, range=0..1),
    StepSize=Slider(0.2, range=0..1))  # -> UpdatedAgents, Positions; inputs Surface: Surface, RepulsorPts: list of Point3d, MinDistance: Double, Agents: list, RepulsionWeight: Double, CurvatureWeight: Double, SeparationWeight: Double
# ---------- agent_simulator: Python ----------
"""GhPython Script: Agent Simulator
Inputs:
    Surface          : Rhino surface (rg.Surface or rg.BrepFace)
    Agents           : list of Agent objects (from builder)
    RepulsorPts      : list of Point3d obstacles
    MinDistance      : float, separation threshold
    StepSize         : float, movement step size
    SeparationWeight : float
    CurvatureWeight  : float
    RepulsionWeight  : float
    BoundaryWeight   : float
    RunStep          : bool, trigger simulation step
    Reset            : bool, reset simulation
Outputs:
    UpdatedAgents : list of Agent objects
    Positions     : list of Point3d positions
"""

import Rhino.Geometry as rg
import random
import scriptcontext as sc

# -- Agent class --
class Agent:
    """Holds 3D position, velocity, and frozen state."""
    def __init__(self, position, velocity):
        self.position = position
        self.velocity = velocity
        self.frozen = False

# -- Utility functions --
def _domains(surface):
    du = surface.Domain(0)
    dv = surface.Domain(1)
    return du, dv

def _clamp_param(du, dv, u, v):
    """Clamp (u, v) to valid parameter domains."""
    if u < du.T0: u = du.T0
    if u > du.T1: u = du.T1
    if v < dv.T0: v = dv.T0
    if v > dv.T1: v = dv.T1
    return u, v

def is_near_edge(surface, pt, threshold=1e-3):
    """Check proximity to param edges; small threshold in param units."""
    success, u, v = surface.ClosestPoint(pt)
    if not success: return False
    du, dv = _domains(surface)
    return (abs(u - du.T0) < threshold or abs(u - du.T1) < threshold or
            abs(v - dv.T0) < threshold or abs(v - dv.T1) < threshold)

def clamp_to_surface(surface, pt):
    """Project point back onto the surface."""
    success, u, v = surface.ClosestPoint(pt)
    return surface.PointAt(u, v) if success else pt

def compute_separation(agent, agents, min_dist):
    """Push agents apart if closer than min_dist."""
    vec = rg.Vector3d(0, 0, 0)
    for other in agents:
        if other is agent or getattr(other, "frozen", False): continue
        d = agent.position.DistanceTo(other.position)
        if 0.0 < d < min_dist:
            away = agent.position - other.position
            if away.IsZero: continue
            away.Unitize()
            vec += away * (min_dist - d)
    return vec

def compute_curvature_gradient(surface, pt, delta=0.01):
    """
    Approximate gradient of ABSOLUTE Gaussian curvature at pt via finite differences.
    - Samples K at (u, v), (u + Δu, v), (u, v + Δv) with Δ scaled by domain length.
    - Maps param deltas to 3D using normalized PointAt differences along u and v.
    """
    success, u, v = surface.ClosestPoint(pt)
    if not success: return rg.Vector3d(0, 0, 0)

    du, dv = _domains(surface)
    du_len = (du.T1 - du.T0)
    dv_len = (dv.T1 - dv.T0)
    if du_len <= 0 or dv_len <= 0:
        return rg.Vector3d(0, 0, 0)

    du_step = delta * du_len
    dv_step = delta * dv_len

    u1, v1 = _clamp_param(du, dv, u + du_step, v)
    u2, v2 = _clamp_param(du, dv, u, v + dv_step)

    try:
        c0 = surface.CurvatureAt(u, v)
        cu = surface.CurvatureAt(u1, v1)
        cv = surface.CurvatureAt(u2, v2)
    except:
        return rg.Vector3d(0, 0, 0)

    if not c0 or not cu or not cv:
        return rg.Vector3d(0, 0, 0)

    # Absolute Gaussian curvature
    k0 = abs(c0.Gaussian)
    k_u = abs(cu.Gaussian)
    k_v = abs(cv.Gaussian)

    dU = k_u - k0
    dV = k_v - k0

    p00 = surface.PointAt(u, v)
    p10 = surface.PointAt(u1, v1)
    p01 = surface.PointAt(u2, v2)

    du_vec = p10 - p00
    dv_vec = p01 - p00
    if du_vec.IsZero or dv_vec.IsZero:
        return rg.Vector3d(0, 0, 0)

    du_vec.Unitize()
    dv_vec.Unitize()

    grad = du_vec * dU + dv_vec * dV
    return grad

def compute_repulsion(agent, repulsorPts):
    """Inverse-distance push away from repulsor points."""
    vec = rg.Vector3d(0, 0, 0)
    if not repulsorPts: return vec
    for rp in repulsorPts:
        d = agent.position.DistanceTo(rp)
        if d <= 0: continue
        away = agent.position - rp
        if away.IsZero: continue
        away.Unitize()
        vec += away / d
    return vec

def compute_boundary_force(surface, pt, threshold=0.05):
    """
    If close to any param boundary (normalized param distance < threshold),
    pull toward the param-space center of the surface.
    """
    success, u, v = surface.ClosestPoint(pt)
    if not success: return rg.Vector3d(0, 0, 0)
    du, dv = _domains(surface)
    du_len = (du.T1 - du.T0)
    dv_len = (dv.T1 - dv.T0)
    if du_len <= 0 or dv_len <= 0:
        return rg.Vector3d(0, 0, 0)

    dist_u = min(abs(u - du.T0), abs(du.T1 - u)) / du_len
    dist_v = min(abs(v - dv.T0), abs(dv.T1 - v)) / dv_len

    if dist_u < threshold or dist_v < threshold:
        center_u = 0.5 * (du.T0 + du.T1)
        center_v = 0.5 * (dv.T0 + dv.T1)
        center = surface.PointAt(center_u, center_v)
        vec = center - pt
        if vec.IsZero: return rg.Vector3d(0, 0, 0)
        vec.Unitize()
        return vec

    return rg.Vector3d(0, 0, 0)

# -- Sticky key --
KEY = "AgentSimulator::sticky_agents"

# -- Reset --
if Reset:
    new_agents = []
    if Agents and len(Agents) > 0:
        # Copy agents from builder; freeze if near edge
        for src in Agents:
            ag = Agent(src.position, src.velocity)
            ag.frozen = getattr(src, "frozen", is_near_edge(Surface, ag.position))
            new_agents.append(ag)
    sc.sticky[KEY] = new_agents

# -- Initialize storage --
if KEY not in sc.sticky:
    sc.sticky[KEY] = []
UpdatedAgents = sc.sticky[KEY]

# -- Step update --
if RunStep and UpdatedAgents:
    for agent in UpdatedAgents:
        if agent.frozen: continue

        sep = compute_separation(agent, UpdatedAgents, MinDistance)
        curv = compute_curvature_gradient(Surface, agent.position)
        rep = compute_repulsion(agent, RepulsorPts)
        bound = compute_boundary_force(Surface, agent.position)

        move = (sep * SeparationWeight +
                curv * CurvatureWeight +
                rep * RepulsionWeight +
                bound * BoundaryWeight)

        if move.Length > 0:
            move.Unitize()
            agent.velocity = move * StepSize
            new_pos = agent.position + agent.velocity
            if is_near_edge(Surface, new_pos):
                agent.velocity = rg.Vector3d(0, 0, 0)
                # Optionally freeze: agent.frozen = True
            else:
                agent.position = clamp_to_surface(Surface, new_pos)

# -- Outputs --
sc.sticky[KEY] = UpdatedAgents
Positions = [a.position for a in UpdatedAgents]
# ---------- end agent_simulator ----------
deconstruct = Deconstruct(Point=agent_simulator.Positions)  # -> XComponent, YComponent, ZComponent
delaunay_mesh = DelaunayMesh(Points=agent_simulator.Positions, Plane=PlaneXY(0, 0, 0))
mesh_sphere = MeshSphere(Base=agent_simulator.Positions, Radius=0.15, UCount=10, VCount=20)
bounds = Bounds(Numbers=deconstruct.ZComponent)
mesh = Mesh(delaunay_mesh)
deconstruct_domain = DeconstructDomain(Domain=bounds)  # -> Start, End
gradient = Gradient(
    LowerLimit=deconstruct_domain.Start,
    UpperLimit=deconstruct_domain.End,
    Parameter=deconstruct.ZComponent,
    stops=[0: RGB(75, 107, 169), 0.246: RGB(173, 203, 249), 0.5: RGB(254, 244, 84), 0.749: RGB(234, 126, 0), 1: RGB(234, 38, 0)])
custom_preview = CustomPreview(Geometry=mesh_sphere, Material=ColourSwatch(SwatchColor=RGB(255, 255, 255)))

# ----
number_slider = Slider(4, range=0..100)  # disabled
number_slider_2 = Slider(4, range=0..100)  # disabled
rectangular = Rectangular(Plane=PlaneXY(0, 0, 0), SizeX=4, SizeY=4, ExtentX=number_slider, ExtentY=number_slider_2)  # -> Cells, flatten(Points); disabled
number_slider_3 = Slider(11, range=0..100)  # disabled
list_length = ListLength(List=rectangular.Points)  # disabled
random = Random(Range=Domain(0, 1), Number=list_length, Seed=number_slider_3)  # disabled
unit_z = UnitZ(Factor=expr("x*3", random))  # disabled
move = Move(Geometry=rectangular.Points, Motion=unit_z)  # -> Geometry, Transform; disabled
surface_from_points = SurfaceFromPoints(Points=move.Geometry, UCount=expr("x+1", number_slider), Interpolate=False)  # disabled
number_slider_4 = Slider(100, range=0..1000)  # disabled
brep_edges = BrepEdges(Brep=surface_from_points)  # -> Naked, Interior, NonManifold; disabled
number_slider_5 = Slider(1, range=0..10)  # disabled
number_slider_6 = Slider(0.5, range=0..1)  # disabled
agent_builder_2 = Python3Script(Srf=surface_from_points, N=number_slider_4)  # -> Positions, Agents; inputs Srf: Surface, N: Int32; disabled
# ---------- agent_builder_2: Python ----------
"""GhPython Agent Builder Component
Inputs:
    Srf : Surface (Rhino.Geometry.Surface)
    N   : Number of agents (int)
Outputs:
    Agents : List of Agent objects
    Positions : List of starting positions (Rhino.Geometry.Point3d)
"""

import random
import numpy as np
import rhinoscriptsyntax as rs
import Rhino.Geometry as rg

# -------------------------------
# Agent Class
# -------------------------------
class Agent(object):
    def __init__(self, position, velocity, id=None):
        self.id = id
        self.position = position          # Rhino.Geometry.Point3d
        self.velocity = velocity          # Rhino.Geometry.Vector3d
        self.history = [position]         # store trajectory
        self.sensed = {}                  # dictionary for sensed signals

    def sense(self, signals):
        # signals could be dict with "slope", "repulsors", etc.
        self.sensed = signals

    def decide(self):
        # placeholder: update velocity based on sensed info
        # for now, keep velocity unchanged
        pass

    def move(self, surface):
        # update position by velocity
        new_pos = rg.Point3d(
            self.position.X + self.velocity.X,
            self.position.Y + self.velocity.Y,
            self.position.Z + self.velocity.Z
        )
    
        # clamp to surface domain (project to surface)
        success, u, v = surface.ClosestPoint(new_pos)
        if success:
            new_pos = surface.PointAt(u, v)
        else:
            # if projection fails, stay at previous position
            new_pos = self.position

        self.position = new_pos
        self.history.append(new_pos)


    def update(self, all_agents, signals, surface):
        self.sense(signals)
        self.decide()
        self.move(surface)


# -------------------------------
# Build Agents Function
# -------------------------------
def build_agents(surface, number_of_agents, initial_positions=None):
    agents = []
    positions = []
    u_domain = surface.Domain(0)
    v_domain = surface.Domain(1)

    for i in range(number_of_agents):
        if initial_positions and i < len(initial_positions):
            pos = initial_positions[i]
        else:
            # random UV location on surface
            u = random.uniform(u_domain.Min, u_domain.Max)
            v = random.uniform(v_domain.Min, v_domain.Max)
            pos = surface.PointAt(u, v)

        # small random velocity vector
        vel = rg.Vector3d(
            random.uniform(-0.5, 0.5),
            random.uniform(-0.5, 0.5),
            0.0
        )

        agent = Agent(pos, vel, id=i)
        agents.append(agent)
        positions.append(pos)

    return agents, positions


# -------------------------------
# Grasshopper Execution
# -------------------------------
if Srf and N:
    Agents, Positions = build_agents(Srf, N)
else:
    Agents, Positions = [], []
# ---------- end agent_builder_2 ----------
divide_curve = DivideCurve(Curve=brep_edges.Naked, Count=50, Kinks=False)  # -> flatten(Points), Tangents, Parameters; disabled
point_2 = Point(agent_builder_2.Positions)  # disabled
number_slider_7 = Slider(1.5, range=0..10)  # disabled
button = Button()  # disabled
agent_simulator_2 = Python3Script(
    Srf=surface_from_points,
    Agents=agent_builder_2.Agents,
    Repulsors=divide_curve.Points,
    Steps=number_slider_5,
    StepSize=number_slider_6,
    Reset=button,
    MinDist=number_slider_7)  # -> Agents, Trajectories, LastPositions; inputs Srf: Surface, Agents: list, Repulsors: list of Point3d, Steps: Int32, StepSize: Double, Reset: Boolean, MinDist: Double; disabled
# ---------- agent_simulator_2: Python ----------
import Rhino.Geometry as rg

# -------------------------------
# Repulsor class
# -------------------------------
class Repulsor:
    def __init__(self, position, strength=1.0):
        self.position = position
        self.strength = strength

    def influence(self, agent_pos):
        if not isinstance(agent_pos, rg.Point3d):
            agent_pos = rg.Point3d(agent_pos[0], agent_pos[1], agent_pos[2])
        dir_vector = rg.Vector3d(agent_pos.X - self.position.X,
                                 agent_pos.Y - self.position.Y,
                                 agent_pos.Z - self.position.Z)
        dist = dir_vector.Length
        if dist == 0:
            return rg.Vector3d(0,0,0)
        dir_vector.Unitize()
        return dir_vector * (self.strength / dist**2)

# -------------------------------
# Curvature magnitude using normal differences
# -------------------------------
def curvature_magnitude(surface, u, v, delta=0.001):
    normal = surface.NormalAt(u, v)
    u1 = max(surface.Domain(0).Min, min(surface.Domain(0).Max, u + delta))
    normal_u = surface.NormalAt(u1, v)
    v1 = max(surface.Domain(1).Min, min(surface.Domain(1).Max, v + delta))
    normal_v = surface.NormalAt(u, v1)
    vec_u = normal_u - normal
    vec_v = normal_v - normal
    return max(vec_u.Length, vec_v.Length)

# -------------------------------
# Curvature-based movement toward peaks
# -------------------------------
def compute_curvature_peak_vector(surface, point, step=0.2):
    success, u, v = surface.ClosestPoint(point)
    if not success:
        return rg.Vector3d(0,0,0)

    neighbors = [
        (u + step, v), (u - step, v),
        (u, v + step), (u, v - step),
        (u + step, v + step), (u + step, v - step),
        (u - step, v + step), (u - step, v - step)
    ]

    max_curv = -1
    best_vec = rg.Vector3d(0,0,0)

    for nu, nv in neighbors:
        nu = max(surface.Domain(0).Min, min(surface.Domain(0).Max, nu))
        nv = max(surface.Domain(1).Min, min(surface.Domain(1).Max, nv))
        curv_mag = curvature_magnitude(surface, nu, nv)
        if curv_mag > max_curv:
            max_curv = curv_mag
            neighbor_pt = surface.PointAt(nu, nv)
            vec = rg.Vector3d(neighbor_pt.X - point.X,
                              neighbor_pt.Y - point.Y,
                              neighbor_pt.Z - point.Z)
            best_vec = vec

    if best_vec.Length > 0:
        best_vec.Unitize()
    return best_vec

# -------------------------------
# Compute separation vector between agents
# -------------------------------
def compute_separation(agent, agents, min_dist):
    sep_vec = rg.Vector3d(0,0,0)
    for other in agents:
        if other is agent:
            continue
        vec = rg.Vector3d(agent.position.X - other.position.X,
                          agent.position.Y - other.position.Y,
                          agent.position.Z - other.position.Z)
        dist = vec.Length
        if dist < min_dist and dist > 0:
            vec.Unitize()
            sep_vec += vec * (min_dist - dist)
    return sep_vec

# -------------------------------
# Single simulation step
# -------------------------------
def agent_simulation_step(agents, surface, repulsors, step_size=0.5,
                          curvature_weight=0.25, repulsor_weight=0.5, separation_weight=0.5,
                          min_dist=3):
    for agent in agents:
        # Curvature peak vector
        curv_vec = compute_curvature_peak_vector(surface, agent.position)
        # Repulsor influence
        rep_vec = rg.Vector3d(0,0,0)
        for r in repulsors:
            rep_vec += r.influence(agent.position)
        # Separation vector
        sep_vec = compute_separation(agent, agents, min_dist)

        # Weighted combination
        combined = rg.Vector3d(
            curvature_weight*curv_vec.X + repulsor_weight*rep_vec.X + separation_weight*sep_vec.X,
            curvature_weight*curv_vec.Y + repulsor_weight*rep_vec.Y + separation_weight*sep_vec.Y,
            curvature_weight*curv_vec.Z + repulsor_weight*rep_vec.Z + separation_weight*sep_vec.Z
        )

        if combined.Length > 0:
            combined.Unitize()
            combined *= step_size
            agent.velocity = combined

            # Move agent and clamp to surface
            new_pos = rg.Point3d(agent.position.X + agent.velocity.X,
                                 agent.position.Y + agent.velocity.Y,
                                 agent.position.Z + agent.velocity.Z)
            success, u, v = surface.ClosestPoint(new_pos)
            if success:
                new_pos = surface.PointAt(u, v)
            else:
                new_pos = agent.position
            agent.position = new_pos
            agent.history.append(new_pos)

# -------------------------------
# Initialize Repulsor objects
# -------------------------------
RepObjs = [Repulsor(p, strength=1.0) for p in Repulsors] if Repulsors else []

# -------------------------------
# Reset agent velocities if requested (keep history)
# -------------------------------
if Reset:
    for agent in Agents:
        agent.velocity = rg.Vector3d(0,0,0)

# -------------------------------
# Run simulation
# -------------------------------
for _ in range(Steps):
    agent_simulation_step(Agents, Srf, RepObjs, step_size=StepSize,
                          curvature_weight=0.7, repulsor_weight=0.2,
                          separation_weight=0.3, min_dist=MinDist)

# -------------------------------
# Build Trajectories
# -------------------------------
Trajectories = []
for agent in Agents:
    if len(agent.history) > 1:
        Trajectories.append(rg.Polyline(agent.history))
    else:
        Trajectories.append(rg.Polyline([agent.history[0], agent.history[0]]))

# -------------------------------
# Last positions
# -------------------------------
LastPositions = [agent.position for agent in Agents]
# ---------- end agent_simulator_2 ----------
merge = Merge(Data1=divide_curve.Points, Data2=agent_simulator_2.LastPositions)  # -> flatten(Result); disabled
delaunay_edges = DelaunayEdges(Points=merge, Plane=PlaneXY(0, 0, 0))  # -> Connectivity, Edges; disabled
point_3 = Point(agent_simulator_2.LastPositions)  # disabled
deconstruct_2 = Deconstruct(Point=point_3)  # -> XComponent, YComponent, ZComponent; disabled
merge_2 = Merge(Data1=divide_curve.Points, Data2=point_3)  # -> flatten(Result); disabled
line = Line(delaunay_edges.Edges)  # disabled
mesh_sphere_2 = MeshSphere(Base=point_3, Radius=0.15, UCount=10, VCount=20)  # disabled
bounds_2 = Bounds(Numbers=deconstruct_2.ZComponent)  # disabled
deconstruct_domain_2 = DeconstructDomain(Domain=bounds_2)  # -> Start, End; disabled
delaunay_mesh_2 = DelaunayMesh(Points=merge_2, Plane=PlaneXY(0, 0, 0))  # disabled
gradient_2 = Gradient(
    LowerLimit=deconstruct_domain_2.Start,
    UpperLimit=deconstruct_domain_2.End,
    Parameter=deconstruct_2.ZComponent,
    stops=[0: RGB(75, 107, 169), 0.246: RGB(173, 203, 249), 0.5: RGB(254, 244, 84), 0.749: RGB(234, 126, 0), 1: RGB(234, 38, 0)])  # disabled
custom_preview_2 = CustomPreview(Geometry=mesh_sphere_2, Material=gradient_2)  # disabled

number_slider_8 = Slider(5, range=0..100)  # disabled
number_slider_9 = Slider(5, range=0..100)  # disabled
rectangular_2 = Rectangular(Plane=PlaneXY(0, 0, 0), SizeX=4, SizeY=4, ExtentX=number_slider_8, ExtentY=number_slider_9)  # -> Cells, flatten(Points); disabled
number_slider_10 = Slider(11, range=0..100)  # disabled
list_length_2 = ListLength(List=rectangular_2.Points)  # disabled
random_2 = Random(Range=Domain(0, 1), Number=list_length_2, Seed=number_slider_10)  # disabled
unit_z_2 = UnitZ(Factor=expr("x*3", random_2))  # disabled
move_2 = Move(Geometry=rectangular_2.Points, Motion=unit_z_2)  # -> Geometry, Transform; disabled
surface_from_points_2 = SurfaceFromPoints(Points=move_2.Geometry, UCount=expr("x+1", number_slider_8), Interpolate=invert(False))  # disabled
number_slider_11 = Slider(9, range=0..10)  # disabled
number_slider_12 = Slider(9, range=0..10)  # disabled
number_slider_13 = Slider(14, range=0..100)  # disabled
deconstruct_brep = DeconstructBrep(Brep=surface_from_points_2)  # -> Faces, Edges, Vertices; disabled
agent_builder_3 = Python3Script(Srf=surface_from_points_2, DivU=number_slider_13, DivV=number_slider_13)  # -> Pts, Agents; inputs Srf: Surface, DivU: Int32, DivV: Int32; disabled
# ---------- agent_builder_3: Python ----------
import rhinoscriptsyntax as rs
import Rhino
import Rhino.Geometry as rg


# ---------------------------------------------------------
# Agent CLASS
# ---------------------------------------------------------

class Agent:
    """
    A simple agent containing:
    - position (Point3d)
    - velocity (Vector3d)
    - placeholders for simulation parameters (for Component 2)
    """

    def __init__(self, position, velocity):
        self.position = position
        self.velocity = velocity

        # Simulation parameters (filled later in Simulator component)
        self.min_distance = None
        self.curvature_value = None
        self.repulsor_forces = []

        # Optional ID
        self.id = None

    def initialize_state(self):
        """Not used in Component 1."""
        pass


# ---------------------------------------------------------
# FACTORY — BUILD AGENTS FROM SURFACE
# ---------------------------------------------------------

def build_agents(surface, div_u, div_v):
    if surface is None:
        return [], []

    if div_u < 1 or div_v < 1:
        return [], []

    agents = []
    points = []
    agent_id = 0

    # Ensure full domain access
    dom_u = surface.Domain(0)
    dom_v = surface.Domain(1)

    # Loop through UV grid
    for i in range(div_u + 1):
        u = dom_u.T0 + (float(i) / div_u) * (dom_u.T1 - dom_u.T0)

        for j in range(div_v + 1):
            v = dom_v.T0 + (float(j) / div_v) * (dom_v.T1 - dom_v.T0)

            # Surface point
            pt = surface.PointAt(u, v)
            points.append(pt)

            # Agent with zero velocity
            vel = rg.Vector3d(0, 0, 0)
            agent = Agent(pt, vel)
            agent.id = agent_id
            agent_id += 1

            agents.append(agent)

    return agents, points


# ---------------------------------------------------------
# GH INPUTS → GhPython OUTPUTS
# ---------------------------------------------------------

Agents, Pts = build_agents(Srf, DivU, DivV)
# ---------- end agent_builder_3 ----------
number_slider_14 = Slider(0.4, range=0..1)  # disabled
number_slider_15 = Slider(0.4, range=0..1)  # disabled
number_slider_16 = Slider(1, range=0..1)  # disabled
number_slider_17 = Slider(0.4, range=0..1)  # disabled
number_slider_18 = Slider(1, range=0..10)  # disabled
number_slider_19 = Slider(0, range=0..1)  # disabled
button_2 = Button()  # disabled
button_3 = Button()  # disabled
agent_simulator_3 = Python3Script(
    Surface=surface_from_points_2,
    RepulsorPts=deconstruct_brep.Vertices,
    MinDistance=number_slider_18,
    Agents=agent_builder_3.Agents,
    RunStep=button_2,
    Reset=button_3,
    RepulsionWeight=number_slider_19,
    CurvatureWeight=number_slider_14,
    SeparationWeight=number_slider_15,
    BoundaryWeight=number_slider_16,
    StepSize=number_slider_17)  # -> UpdatedAgents, Positions; inputs Surface: Surface, RepulsorPts: list of Point3d, MinDistance: Double, Agents: list, RepulsionWeight: Double, CurvatureWeight: Double, SeparationWeight: Double; disabled
# ---------- agent_simulator_3: Python ----------
import Rhino.Geometry as rg
import random
import scriptcontext as sc

# INPUTS:
# Surface: rg.Surface
# RepulsorPts: list[rg.Point3d]
# MinDistance: float
# Agents: list[Agent] from builder (used only for seeding on Reset)
# RunStep: bool
# Reset: bool
# RepulsionWeight: float
# CurvatureWeight: float
# SeparationWeight: float
# BoundaryWeight: float   # slider
# StepSize: float         # slider

# OUTPUTS:
# UpdatedAgents: list[Agent]
# Positions: list[rg.Point3d]

class Agent:
    def __init__(self, position, velocity):
        self.position = position
        self.velocity = velocity
        self.frozen = False

def is_near_edge(surface, pt, threshold=1e-3):
    success, u, v = surface.ClosestPoint(pt)
    if not success: return False
    du = surface.Domain(0); dv = surface.Domain(1)
    return (abs(u-du.T0)<threshold or abs(u-du.T1)<threshold or
            abs(v-dv.T0)<threshold or abs(v-dv.T1)<threshold)

def random_point_on_surface(surface):
    du = surface.Domain(0); dv = surface.Domain(1)
    u = random.uniform(du.T0, du.T1)
    v = random.uniform(dv.T0, dv.T1)
    return surface.PointAt(u, v)

def clamp_to_surface(surface, pt):
    success, u, v = surface.ClosestPoint(pt)
    return surface.PointAt(u, v) if success else pt

def compute_separation(agent, agents, min_dist):
    vec = rg.Vector3d(0,0,0)
    for other in agents:
        if other is agent or other.frozen: continue
        d = agent.position.DistanceTo(other.position)
        if 0 < d < min_dist:
            away = agent.position - other.position
            away.Unitize()
            vec += away * (min_dist - d)
    return vec

# --- NEW curvature gradient steering ---
def compute_curvature_gradient(surface, pt, delta=0.01):
    success, u, v = surface.ClosestPoint(pt)
    if not success: return rg.Vector3d(0,0,0)

    props_center = surface.CurvatureAt(u,v)
    props_u = surface.CurvatureAt(u+delta,v)
    props_v = surface.CurvatureAt(u,v+delta)
    if not props_center or not props_u or not props_v:
        return rg.Vector3d(0,0,0)

    dU = props_u.Gaussian - props_center.Gaussian
    dV = props_v.Gaussian - props_center.Gaussian

    # tangent directions
    du_vec = surface.PointAt(u+delta,v) - surface.PointAt(u,v)
    dv_vec = surface.PointAt(u,v+delta) - surface.PointAt(u,v)
    if du_vec.IsZero or dv_vec.IsZero: return rg.Vector3d(0,0,0)
    du_vec.Unitize(); dv_vec.Unitize()

    grad = du_vec*dU + dv_vec*dV
    return grad

def compute_repulsion(agent, repulsorPts):
    vec = rg.Vector3d(0,0,0)
    if not repulsorPts: return vec
    for rp in repulsorPts:
        d = agent.position.DistanceTo(rp)
        if d > 0:
            away = agent.position - rp
            away.Unitize()
            vec += away / d
    return vec

def compute_boundary_force(surface, pt, threshold=0.05):
    success, u, v = surface.ClosestPoint(pt)
    if not success: return rg.Vector3d(0,0,0)
    du = surface.Domain(0); dv = surface.Domain(1)
    dist_u = min(abs(u-du.T0), abs(du.T1-u)) / (du.T1-du.T0)
    dist_v = min(abs(v-dv.T0), abs(dv.T1-v)) / (dv.T1-dv.T0)
    vec = rg.Vector3d(0,0,0)
    if dist_u < threshold or dist_v < threshold:
        center = surface.PointAt((du.T0+du.T1)/2, (dv.T0+dv.T1)/2)
        vec = center - pt
        vec.Unitize()
    return vec

KEY = "AgentSimulator::sticky_agents"

# Reset: wipe and reseed
if Reset:
    new_agents = []
    if Agents and len(Agents) > 0:
        for src in Agents:
            ag = Agent(src.position, src.velocity)
            ag.frozen = getattr(src, "frozen", is_near_edge(Surface, ag.position))
            new_agents.append(ag)
    else:
        for i in range(100):
            pt = random_point_on_surface(Surface)
            ag = Agent(pt, rg.Vector3d(0,0,0))
            ag.frozen = is_near_edge(Surface, pt)
            new_agents.append(ag)
    sc.sticky[KEY] = new_agents

if KEY not in sc.sticky:
    sc.sticky[KEY] = []

UpdatedAgents = sc.sticky[KEY]

# RunStep: advance in place
if RunStep and UpdatedAgents:
    for agent in UpdatedAgents:
        if agent.frozen: continue
        sep = compute_separation(agent, UpdatedAgents, MinDistance)
        curv_grad = compute_curvature_gradient(Surface, agent.position)
        rep = compute_repulsion(agent, RepulsorPts)
        boundary = compute_boundary_force(Surface, agent.position)

        move = sep*SeparationWeight + curv_grad*CurvatureWeight + rep*RepulsionWeight + boundary*BoundaryWeight

        if move.Length > 0:
            move.Unitize()
            agent.velocity = move * StepSize   # scaled by slider
            new_pos = agent.position + agent.velocity
            if is_near_edge(Surface, new_pos):
                agent.velocity = rg.Vector3d(0,0,0)
            else:
                agent.position = clamp_to_surface(Surface, new_pos)

sc.sticky[KEY] = UpdatedAgents
Positions = [a.position for a in UpdatedAgents]
# ---------- end agent_simulator_3 ----------
mesh_sphere_3 = MeshSphere(Base=agent_simulator_3.Positions, Radius=0.15, UCount=10, VCount=20)  # disabled
deconstruct_3 = Deconstruct(Point=agent_simulator_3.Positions)  # -> XComponent, YComponent, ZComponent; disabled
bounds_3 = Bounds(Numbers=deconstruct_3.ZComponent)  # disabled
deconstruct_domain_3 = DeconstructDomain(Domain=bounds_3)  # -> Start, End; disabled
delaunay_mesh_3 = DelaunayMesh(Points=agent_simulator_3.Positions, Plane=PlaneXY(0, 0, 0))  # disabled
gradient_3 = Gradient(
    LowerLimit=deconstruct_domain_3.Start,
    UpperLimit=deconstruct_domain_3.End,
    Parameter=deconstruct_3.ZComponent,
    stops=[0: RGB(75, 107, 169), 0.246: RGB(173, 203, 249), 0.5: RGB(254, 244, 84), 0.749: RGB(234, 126, 0), 1: RGB(234, 38, 0)])  # disabled
custom_preview_3 = CustomPreview(Geometry=mesh_sphere_3, Material=gradient_3)  # disabled
mesh_2 = Mesh(delaunay_mesh_3)  # disabled

number_slider_20 = Slider(5, range=0..100)  # disabled
number_slider_21 = Slider(5, range=0..100)  # disabled
rectangular_3 = Rectangular(Plane=PlaneXY(0, 0, 0), SizeX=4, SizeY=4, ExtentX=number_slider_20, ExtentY=number_slider_21)  # -> Cells, flatten(Points); disabled
number_slider_22 = Slider(11, range=0..100)  # disabled
list_length_3 = ListLength(List=rectangular_3.Points)  # disabled
random_3 = Random(Range=Domain(0, 1), Number=list_length_3, Seed=number_slider_22)  # disabled
unit_z_3 = UnitZ(Factor=expr("x*3", random_3))  # disabled
move_3 = Move(Geometry=rectangular_3.Points, Motion=unit_z_3)  # -> Geometry, Transform; disabled
surface_from_points_3 = SurfaceFromPoints(Points=move_3.Geometry, UCount=expr("x+1", number_slider_20), Interpolate=invert(False))  # disabled
number_slider_23 = Slider(9, range=0..10)  # disabled
number_slider_24 = Slider(9, range=0..10)  # disabled
number_slider_25 = Slider(14, range=0..100)  # disabled
deconstruct_brep_2 = DeconstructBrep(Brep=surface_from_points_3)  # -> Faces, Edges, Vertices; disabled
agent_builder_4 = Python3Script(Srf=surface_from_points_3, DivU=number_slider_25, DivV=number_slider_25)  # -> Pts, Agents; inputs Srf: Surface, DivU: Int32, DivV: Int32; disabled; same code as agent_builder_3
number_slider_26 = Slider(50, range=0..50)  # disabled
number_slider_27 = Slider(0.1, range=0..1)  # disabled
number_slider_28 = Slider(0.7, range=0..1)  # disabled
number_slider_29 = Slider(1, range=0..1)  # disabled
number_slider_30 = Slider(0.2, range=0..1)  # disabled
number_slider_31 = Slider(1, range=0..10)  # disabled
number_slider_32 = Slider(0, range=0..1)  # disabled
button_4 = Button()  # disabled
agent_simulator_4 = Python3Script(
    Surface=surface_from_points_3,
    RepulsorPts=deconstruct_brep_2.Vertices,
    MinDistance=number_slider_31,
    Agents=agent_builder_4.Agents,
    Iterations=number_slider_26,
    Reset=button_4,
    RepulsionWeight=number_slider_32,
    CurvatureWeight=number_slider_27,
    SeparationWeight=number_slider_28,
    BoundaryWeight=number_slider_29,
    StepSize=number_slider_30)  # -> UpdatedAgents, Positions; inputs Surface: Surface, RepulsorPts: list of Point3d, MinDistance: Double, Agents: list, Iterations: Int32, RepulsionWeight: Double, CurvatureWeight: Double, SeparationWeight: Double; disabled
# ---------- agent_simulator_4: Python ----------
import Rhino.Geometry as rg
import random
import scriptcontext as sc

# INPUTS:
# Surface: rg.Surface
# RepulsorPts: list[rg.Point3d]
# MinDistance: float
# Agents: list[Agent] from builder (used only for seeding on Reset)
# Iterations: int   # slider input (frame counter)
# Reset: bool       # button input
# RepulsionWeight: float
# CurvatureWeight: float
# SeparationWeight: float
# BoundaryWeight: float   # slider
# StepSize: float         # slider

# OUTPUTS:
# UpdatedAgents: list[Agent]
# Positions: list[rg.Point3d]

class Agent:
    def __init__(self, position, velocity):
        self.position = position
        self.velocity = velocity
        self.frozen = False

def is_near_edge(surface, pt, threshold=1e-3):
    success, u, v = surface.ClosestPoint(pt)
    if not success: return False
    du = surface.Domain(0); dv = surface.Domain(1)
    return (abs(u-du.T0)<threshold or abs(u-du.T1)<threshold or
            abs(v-dv.T0)<threshold or abs(v-dv.T1)<threshold)

def random_point_on_surface(surface):
    du = surface.Domain(0); dv = surface.Domain(1)
    u = random.uniform(du.T0, du.T1)
    v = random.uniform(dv.T0, dv.T1)
    return surface.PointAt(u, v)

def clamp_to_surface(surface, pt):
    success, u, v = surface.ClosestPoint(pt)
    return surface.PointAt(u, v) if success else pt

def compute_separation(agent, agents, min_dist):
    vec = rg.Vector3d(0,0,0)
    for other in agents:
        if other is agent or other.frozen: continue
        d = agent.position.DistanceTo(other.position)
        if 0 < d < min_dist:
            away = agent.position - other.position
            away.Unitize()
            vec += away * (min_dist - d)
    return vec

def compute_curvature_gradient(surface, pt, delta=0.01):
    success, u, v = surface.ClosestPoint(pt)
    if not success: 
        return rg.Vector3d(0,0,0)

    props_center = surface.CurvatureAt(u,v)
    props_u = surface.CurvatureAt(u+delta,v)
    props_v = surface.CurvatureAt(u,v+delta)

    if not props_center or not props_u or not props_v:
        return rg.Vector3d(0,0,0)

    # use absolute Gaussian curvature for magnitude
    dU = abs(props_u.Gaussian) - abs(props_center.Gaussian)
    dV = abs(props_v.Gaussian) - abs(props_center.Gaussian)

    # tangent directions
    du_vec = surface.PointAt(u+delta,v) - surface.PointAt(u,v)
    dv_vec = surface.PointAt(u,v+delta) - surface.PointAt(u,v)
    if du_vec.IsZero or dv_vec.IsZero: 
        return rg.Vector3d(0,0,0)
    du_vec.Unitize(); dv_vec.Unitize()

    grad = du_vec*dU + dv_vec*dV
    return grad


def compute_repulsion(agent, repulsorPts):
    vec = rg.Vector3d(0,0,0)
    if not repulsorPts: return vec
    for rp in repulsorPts:
        d = agent.position.DistanceTo(rp)
        if d > 0:
            away = agent.position - rp
            away.Unitize()
            vec += away / d
    return vec

def compute_boundary_force(surface, pt, threshold=0.05):
    success, u, v = surface.ClosestPoint(pt)
    if not success: return rg.Vector3d(0,0,0)
    du = surface.Domain(0); dv = surface.Domain(1)
    dist_u = min(abs(u-du.T0), abs(du.T1-u)) / (du.T1-du.T0)
    dist_v = min(abs(v-dv.T0), abs(dv.T1-v)) / (dv.T1-dv.T0)
    vec = rg.Vector3d(0,0,0)
    if dist_u < threshold or dist_v < threshold:
        center = surface.PointAt((du.T0+du.T1)/2, (dv.T0+dv.T1)/2)
        vec = center - pt
        vec.Unitize()
    return vec

KEY = "AgentSimulator::sticky_agents"
KEY_ITER = "AgentSimulator::last_iteration"

# --- Reset handling ---
if Reset:
    new_agents = []
    if Agents and len(Agents) > 0:
        for src in Agents:
            ag = Agent(src.position, src.velocity)
            ag.frozen = getattr(src, "frozen", is_near_edge(Surface, ag.position))
            new_agents.append(ag)
    else:
        for i in range(100):
            pt = random_point_on_surface(Surface)
            ag = Agent(pt, rg.Vector3d(0,0,0))
            ag.frozen = is_near_edge(Surface, pt)
            new_agents.append(ag)
    sc.sticky[KEY] = new_agents
    sc.sticky[KEY_ITER] = 0  # reset iteration counter

# --- Initialize if missing ---
if KEY not in sc.sticky:
    sc.sticky[KEY] = []
if KEY_ITER not in sc.sticky:
    sc.sticky[KEY_ITER] = 0

UpdatedAgents = sc.sticky[KEY]
last_iter = sc.sticky[KEY_ITER]

# --- Run only the difference ---
steps_to_run = Iterations - last_iter
if steps_to_run > 0 and UpdatedAgents:
    for i in range(steps_to_run):
        for agent in UpdatedAgents:
            if agent.frozen: continue
            sep = compute_separation(agent, UpdatedAgents, MinDistance)
            curv_grad = compute_curvature_gradient(Surface, agent.position)
            rep = compute_repulsion(agent, RepulsorPts)
            boundary = compute_boundary_force(Surface, agent.position)

            move = sep*SeparationWeight + curv_grad*CurvatureWeight + rep*RepulsionWeight + boundary*BoundaryWeight

            if move.Length > 0:
                move.Unitize()
                agent.velocity = move * StepSize
                new_pos = agent.position + agent.velocity
                if is_near_edge(Surface, new_pos):
                    agent.velocity = rg.Vector3d(0,0,0)
                else:
                    agent.position = clamp_to_surface(Surface, new_pos)

    sc.sticky[KEY_ITER] = Iterations  # update iteration counter

# --- Outputs ---
sc.sticky[KEY] = UpdatedAgents
Positions = [a.position for a in UpdatedAgents]
# ---------- end agent_simulator_4 ----------
mesh_sphere_4 = MeshSphere(Base=agent_simulator_4.Positions, Radius=0.15, UCount=10, VCount=20)  # disabled
deconstruct_4 = Deconstruct(Point=agent_simulator_4.Positions)  # -> XComponent, YComponent, ZComponent; disabled
bounds_4 = Bounds(Numbers=deconstruct_4.ZComponent)  # disabled
deconstruct_domain_4 = DeconstructDomain(Domain=bounds_4)  # -> Start, End; disabled
delaunay_mesh_4 = DelaunayMesh(Points=agent_simulator_4.Positions, Plane=PlaneXY(0, 0, 0))  # disabled
colour_swatch = ColourSwatch(SwatchColor=RGB(255, 255, 255))  # disabled
gradient_4 = Gradient(
    LowerLimit=deconstruct_domain_4.Start,
    UpperLimit=deconstruct_domain_4.End,
    Parameter=deconstruct_4.ZComponent,
    stops=[0: RGB(75, 107, 169), 0.246: RGB(173, 203, 249), 0.5: RGB(254, 244, 84), 0.749: RGB(234, 126, 0), 1: RGB(234, 38, 0)])  # disabled
custom_preview_4 = CustomPreview(Geometry=mesh_sphere_4, Material=gradient_4)  # disabled
mesh_3 = Mesh(delaunay_mesh_4)  # disabled

# ---- group: Run iterations
repulsor = MDSlider(
    SliderMode=0,
    slider_value=Point(0.9445417451, 0.09194871856, 0.5),
    x_domain=Domain(0, 1),
    y_domain=Domain(0, 1),
    z_domain=Domain(0, 1))
surface_generator_2 = Python3Script(
    Width=Slider(20, range=0..100),
    Height=Slider(20, range=0..100),
    Scale=Slider(5, range=0..10),
    Seed=Slider(42, range=0..100),
    Amp=Slider(4, range=0..10))  # -> Pts, Surface; inputs Width: Int32, Height: Int32, Scale: Int32, Seed: Int32, Amp: Double; same code as surface_generator
surface_2 = Surface(surface_generator_2.Surface)
evaluate_surface_2 = EvaluateSurface(Surface=reparameterize(surface_2), Point=repulsor)  # -> Point, Normal, UDirection, VDirection, Frame
agent_builder_5 = Python3Script(Srf=surface_2, DivU="14", DivV="14")  # -> Pts, Agents; inputs Srf: Surface, DivU: Int32, DivV: Int32; same code as agent_builder
point_4 = Point(evaluate_surface_2.Point)
agent_simulator_5 = Python3Script(
    Surface=surface_2,
    RepulsorPts=point_4,
    MinDistance=Slider(0.8, range=0..10),
    Agents=agent_builder_5.Agents,
    Iterations=Slider(0, range=0..30),
    Reset=Button(),
    RepulsionWeight=Slider(0, range=0..0.1),
    CurvatureWeight=Slider(1, range=0..1),
    SeparationWeight=Slider(0.7, range=0..1),
    BoundaryWeight=Slider(0.6, range=0..1),
    StepSize=Slider(0.2, range=0..1))  # -> UpdatedAgents, Positions; inputs Surface: Surface, RepulsorPts: list of Point3d, MinDistance: Double, Agents: list, Iterations: Int32, RepulsionWeight: Double, CurvatureWeight: Double, SeparationWeight: Double
# ---------- agent_simulator_5: Python ----------
"""
GhPython Script: Agent Simulator with Incremental Iterations
Inputs:
    Surface          : Rhino surface (rg.Surface or rg.BrepFace)
    Agents           : list of Agent objects (from builder)
    RepulsorPts      : list of Point3d obstacles
    MinDistance      : float, separation threshold
    StepSize         : float, movement step size
    SeparationWeight : float
    CurvatureWeight  : float
    RepulsionWeight  : float
    BoundaryWeight   : float
    Iterations       : int, total simulation steps (slider)
    Reset            : bool, reset simulation
Outputs:
    UpdatedAgents : list of Agent objects
    Positions     : list of Point3d positions
"""

import Rhino.Geometry as rg
import scriptcontext as sc

# -- Agent class --
class Agent:
    """Holds 3D position, velocity, and frozen state."""
    def __init__(self, position, velocity):
        self.position = position
        self.velocity = velocity
        self.frozen = False

# -- Utility functions --
def _domains(surface):
    return surface.Domain(0), surface.Domain(1)

def _clamp_param(du, dv, u, v):
    if u < du.T0: u = du.T0
    if u > du.T1: u = du.T1
    if v < dv.T0: v = dv.T0
    if v > dv.T1: v = dv.T1
    return u, v

def is_near_edge(surface, pt, threshold=1e-3):
    success, u, v = surface.ClosestPoint(pt)
    if not success: return False
    du, dv = _domains(surface)
    return (abs(u - du.T0) < threshold or abs(u - du.T1) < threshold or
            abs(v - dv.T0) < threshold or abs(v - dv.T1) < threshold)

def clamp_to_surface(surface, pt):
    success, u, v = surface.ClosestPoint(pt)
    return surface.PointAt(u, v) if success else pt

def compute_separation(agent, agents, min_dist):
    vec = rg.Vector3d(0, 0, 0)
    for other in agents:
        if other is agent or getattr(other, "frozen", False): continue
        d = agent.position.DistanceTo(other.position)
        if 0.0 < d < min_dist:
            away = agent.position - other.position
            if away.IsZero: continue
            away.Unitize()
            vec += away * (min_dist - d)
    return vec

def compute_curvature_gradient(surface, pt, delta=0.01):
    success, u, v = surface.ClosestPoint(pt)
    if not success: return rg.Vector3d(0, 0, 0)
    du, dv = _domains(surface)
    du_len = du.T1 - du.T0
    dv_len = dv.T1 - dv.T0
    du_step = delta * du_len
    dv_step = delta * dv_len
    u1, v1 = _clamp_param(du, dv, u + du_step, v)
    u2, v2 = _clamp_param(du, dv, u, v + dv_step)
    try:
        c0 = surface.CurvatureAt(u, v)
        cu = surface.CurvatureAt(u1, v1)
        cv = surface.CurvatureAt(u2, v2)
    except:
        return rg.Vector3d(0, 0, 0)
    if not c0 or not cu or not cv: return rg.Vector3d(0,0,0)
    k0 = abs(c0.Gaussian)
    k_u = abs(cu.Gaussian)
    k_v = abs(cv.Gaussian)
    dU = k_u - k0
    dV = k_v - k0
    p00 = surface.PointAt(u, v)
    p10 = surface.PointAt(u1, v1)
    p01 = surface.PointAt(u2, v2)
    du_vec = p10 - p00
    dv_vec = p01 - p00
    if du_vec.IsZero or dv_vec.IsZero: return rg.Vector3d(0,0,0)
    du_vec.Unitize()
    dv_vec.Unitize()
    return du_vec * dU + dv_vec * dV

def compute_repulsion(agent, repulsorPts):
    vec = rg.Vector3d(0,0,0)
    if not repulsorPts: return vec
    for rp in repulsorPts:
        d = agent.position.DistanceTo(rp)
        if d <= 0: continue
        away = agent.position - rp
        if away.IsZero: continue
        away.Unitize()
        vec += away / d
    return vec

def compute_boundary_force(surface, pt, threshold=0.05):
    success, u, v = surface.ClosestPoint(pt)
    if not success: return rg.Vector3d(0,0,0)
    du, dv = _domains(surface)
    du_len = du.T1 - du.T0
    dv_len = dv.T1 - dv.T0
    dist_u = min(abs(u - du.T0), abs(du.T1 - u)) / du_len
    dist_v = min(abs(v - dv.T0), abs(dv.T1 - v)) / dv_len
    if dist_u < threshold or dist_v < threshold:
        center_u = 0.5 * (du.T0 + du.T1)
        center_v = 0.5 * (dv.T0 + dv.T1)
        center = surface.PointAt(center_u, center_v)
        vec = center - pt
        if vec.IsZero: return rg.Vector3d(0,0,0)
        vec.Unitize()
        return vec
    return rg.Vector3d(0,0,0)

# -- Sticky storage keys --
AGENTS_KEY = "AgentSimulator::sticky_agents"
ITER_KEY = "AgentSimulator::last_iteration"

# -- Reset agents --
if Reset:
    new_agents = []
    if Agents:
        for src in Agents:
            ag = Agent(src.position, src.velocity)
            ag.frozen = getattr(src, "frozen", is_near_edge(Surface, ag.position))
            new_agents.append(ag)
    sc.sticky[AGENTS_KEY] = new_agents
    sc.sticky[ITER_KEY] = 0  # reset iteration count

# -- Load agents --
if AGENTS_KEY not in sc.sticky:
    sc.sticky[AGENTS_KEY] = []
UpdatedAgents = sc.sticky[AGENTS_KEY]

# -- Determine new iterations to run --
last_iter = sc.sticky.get(ITER_KEY, 0)
steps_to_run = max(0, Iterations - last_iter)

# -- Run only new iterations --
for _ in range(steps_to_run):
    for agent in UpdatedAgents:
        if agent.frozen: continue
        sep = compute_separation(agent, UpdatedAgents, MinDistance)
        curv = compute_curvature_gradient(Surface, agent.position)
        rep = compute_repulsion(agent, RepulsorPts)
        bound = compute_boundary_force(Surface, agent.position)
        move = (sep * SeparationWeight +
                curv * CurvatureWeight +
                rep * RepulsionWeight +
                bound * BoundaryWeight)
        if move.Length > 0:
            move.Unitize()
            agent.velocity = move * StepSize
            new_pos = agent.position + agent.velocity
            if is_near_edge(Surface, new_pos):
                agent.velocity = rg.Vector3d(0,0,0)
            else:
                agent.position = clamp_to_surface(Surface, new_pos)

# -- Update sticky storage and last iteration --
sc.sticky[AGENTS_KEY] = UpdatedAgents
sc.sticky[ITER_KEY] = Iterations

# -- Output positions --
Positions = [a.position for a in UpdatedAgents]
# ---------- end agent_simulator_5 ----------
deconstruct_5 = Deconstruct(Point=agent_simulator_5.Positions)  # -> XComponent, YComponent, ZComponent
mesh_sphere_5 = MeshSphere(Base=agent_simulator_5.Positions, Radius=0.15, UCount=10, VCount=20)
bounds_5 = Bounds(Numbers=deconstruct_5.ZComponent)
deconstruct_domain_5 = DeconstructDomain(Domain=bounds_5)  # -> Start, End
gradient_5 = Gradient(
    LowerLimit=deconstruct_domain_5.Start,
    UpperLimit=deconstruct_domain_5.End,
    Parameter=deconstruct_5.ZComponent,
    stops=[0: RGB(75, 107, 169), 0.246: RGB(173, 203, 249), 0.5: RGB(254, 244, 84), 0.749: RGB(234, 126, 0), 1: RGB(234, 38, 0)])
custom_preview_5 = CustomPreview(Geometry=mesh_sphere_5, Material=ColourSwatch(SwatchColor=RGB(255, 255, 255)))

# ----
mesh_sphere_6 = MeshSphere(Base=evaluate_surface_2.Point, Radius=0.5, UCount=10, VCount=20)
custom_preview_6 = CustomPreview(Geometry=mesh_sphere_6, Material=ColourSwatch(SwatchColor=RGB(0, 0, 0)))
point_5 = Point(agent_simulator_5.Positions)

# ---- group: Run iterations (continued)
delaunay_mesh_5 = DelaunayMesh(Points=point_5, Plane=PlaneXY(0, 0, 0))
mesh_4 = Mesh(delaunay_mesh_5)
